# Grasshopper definition GCode_CAD3.gh (Grasshopper 1.0.7)
# plug-ins: MetaHopper, Telepathy

number_slider = Slider(25, range=0..100)
number_slider_2 = Slider(70, range=0..100)
number_slider_3 = Slider(20, range=0..100)
neg = Negative(Value=number_slider)
division = Division(A=number_slider_2, B=2)
Z = UnitZ(Factor=number_slider_2)
rectangle = Rectangle(Plane=PlaneXY(0, 0, 0), XSize=number_slider_2, YSize=number_slider_3, Radius=0)  # -> Rectangle, Length
dom = ConstructDomain(DomainStart=neg, DomainEnd=number_slider)
vec = VectorXYZ(XComponent=division, YComponent=0, ZComponent=division)  # -> Vector, Length
extr = Extrude(Base=rectangle.Rectangle, Direction=Z)
xz = XZPlane(Origin=vec.Vector)
number_slider_4 = Slider(80, range=0..100)
number_slider_5 = Slider(30, range=0..100)
cap = CapHoles(Brep=extr)
cir = Circle(Plane=xz, Radius=number_slider)
Y = UnitY(Factor=number_slider_3)
rectangle_2 = Rectangle(Plane=xz, XSize=dom, YSize=dom, Radius=0)  # -> Rectangle, Length

brep = Brep(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)
brep_2 = Brep(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)

data = Data(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)
cir_2 = Circle(Plane=PlaneXY(0, 0, 0), Radius=Slider(5, range=0..100))
Z_2 = UnitZ(Factor=Slider(100, range=0..100))
box = DomainBox(Base=PlaneXY(0, 0, 0), X="1.0", Y=Slider(25, range=0..100), Z=Slider(50, range=0..100))
number_slider_6 = Slider(65, range=0..100)
panel = Panel("ノズル内の体積計算")
extr_2 = Extrude(Base=rectangle_2.Rectangle, Direction=Y)
extr_3 = Extrude(Base=cir_2, Direction=Z_2)
vec_2 = VectorXYZ(XComponent=number_slider_5, YComponent=number_slider_5, ZComponent=0)  # -> Vector, Length
division_2 = Division(A=Y, B=2)
cluster = Cluster_5(B=Slider(1, range=0..1))  # -> R, R_2
move = Move(Geometry=extr_2, Motion=division_2)  # -> Geometry, Transform
panel_2 = Panel("フィラメントの表面積")
move_2 = Move(Geometry=box, Motion=vec_2.Vector)  # -> Geometry, Transform
cap_2 = CapHoles(Brep=extr_3)
panel_3 = Panel("ノズル内の体積")
num = Number(cluster.R_2)
num_2 = Number(cluster.R)
number_slider_7 = Slider(17, range=0..100)

box_2 = DomainBox(Base=PlaneXY(0, 0, 0), X="214", Y="214", Z="230")

cap_3 = CapHoles(Brep=move.Geometry)
brep_3 = Brep(move_2.Geometry)
panel_4 = Panel("CRANE Print Area")
vec_3 = VectorXYZ(XComponent=number_slider_6, YComponent=number_slider_6, ZComponent=0)  # -> Vector, Length
panel_5 = Panel(num_2)
panel_6 = Panel(num)
number_slider_8 = Slider(0.7, range=0..1)
move_3 = Move(Geometry=cap_2, Motion=vec_2.Vector)  # -> Geometry, Transform
neg_2 = Negative(Value=number_slider_7)
number_slider_9 = Slider(30, range=0..100)

mesh = Mesh(cap)
mesh_2 = Mesh(cap_3)

sph = Sphere(Base=PlaneXY(0, 0, 0), Radius=number_slider_7)
number_slider_10 = Slider(1, range=0..1)
cir_3 = Circle(Plane=PlaneXY(0, 0, 0), Radius=Slider(20, range=0..100))

number_slider_11 = Slider(0, range=0..10)

Z_3 = UnitZ(Factor=Slider(58, range=0..100))
dom_2 = ConstructDomain(DomainStart=neg_2, DomainEnd=number_slider_7)
dom_3 = ConstructDomain(DomainStart=neg_2, DomainEnd="0")
data_2 = Data(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)
move_4 = Move(Geometry=mesh, Motion=vec_3.Vector)  # -> Geometry, Transform
move_5 = Move(Geometry=mesh_2, Motion=vec_3.Vector)  # -> Geometry, Transform
vec_4 = VectorXYZ(XComponent=number_slider_8, YComponent=number_slider_8, ZComponent=0)  # -> Vector, Length
extr_4 = Extrude(Base=cir_3, Direction=Z_3)
unset = RemoteSender("layer height")
box_3 = DomainBox(Base=PlaneXY(0, 0, 0), X=dom_2, Y=dom_2, Z=dom_3)
multiplication = Multiplication(A="0.5", B=Slider(0.9, range=0..1))
unset_2 = RemoteSender("nozzle diameter")
unset_3 = RemoteSender("top solid layers")
number_slider_12 = Slider(0.9, range=0..1)
unset_4 = RemoteSender("bottom solid layers")
unset_5 = RemoteSender("infill pitch")
unset_6 = RemoteSender("num of shell")
unset_7 = RemoteSender("Num of Artifacts shells")
unset_8 = RemoteSender(multiplication)
cap_4 = CapHoles(Brep=extr_4)
mesh_3 = Mesh(move_4.Geometry)
evalsrf = EvaluateSurface(Surface=sph, Point=vec_4.Vector)  # -> Point, Normal, UDirection, VDirection, Frame
mesh_4 = Mesh(move_5.Geometry)
unset_9 = RemoteSender("Distance of Artifacts")
unset_10 = RemoteSender(Slider(0.2, range=0..1))
unset_11 = RemoteSender(Slider(2, range=0..10))
unset_12 = RemoteSender(Slider(10, range=0..10))
unset_13 = RemoteSender(Slider(0, range=0..1))
merge = Merge(Data1=Slider(2, range=0..10), Data2=Slider(2, range=0..10))
unset_14 = RemoteSender(Slider(1, range=0..10))
vec_5 = VectorXYZ(XComponent=number_slider_9, YComponent=number_slider_9, ZComponent=0)  # -> Vector, Length
unset_15 = RemoteSender(merge)
pl = PlaneNormal(Origin=evalsrf.Point, ZAxis=evalsrf.Normal)
sdiff = SolidDifference(BrepsA=sph, BrepsB=box_3)
evalsrf_2 = EvaluateSurface(Surface=extr_4, Point=vec_5.Vector)  # -> Point, Normal, UDirection, VDirection, Frame

remote_receiver = RemoteReceiver(unset_8)
remote_receiver_2 = RemoteReceiver(unset_10)
remote_receiver_3 = RemoteReceiver(unset_15)
remote_receiver_4 = RemoteReceiver(unset_11)
remote_receiver_5 = RemoteReceiver(unset_14)
remote_receiver_6 = RemoteReceiver(unset_12)
remote_receiver_7 = RemoteReceiver(unset_13)
remote_receiver_8 = RemoteReceiver(unset_2)
remote_receiver_9 = RemoteReceiver(unset)
remote_receiver_10 = RemoteReceiver(unset_6)
remote_receiver_11 = RemoteReceiver(unset_5)
remote_receiver_12 = RemoteReceiver(unset_7)
remote_receiver_13 = RemoteReceiver(unset_9)
remote_receiver_14 = RemoteReceiver(unset_3)
remote_receiver_15 = RemoteReceiver(unset_4)
merge_2 = Merge(
    Data1=remote_receiver,
    Data2=remote_receiver_2,
    Data3=remote_receiver_3,
    Data4=remote_receiver_4,
    Data5=remote_receiver_7,
    Data6=remote_receiver_5,
    Data7=remote_receiver_6)
merge_3 = Merge(
    Data1=remote_receiver_8,
    Data2=remote_receiver_9,
    Data3=remote_receiver_14,
    Data4=remote_receiver_15,
    Data5=remote_receiver_10,
    Data6=remote_receiver_11,
    Data7=remote_receiver_12,
    Data8=remote_receiver_13)
unset_16 = RemoteSender(merge_2)
unset_17 = RemoteSender(merge_3)

data_3 = Data(mesh_3)
pl_2 = PlaneNormal(Origin=evalsrf_2.Point, ZAxis=evalsrf_2.Normal)
multiplication_2 = Multiplication(A=evalsrf.Normal, B=Slider(20, range=0..100))
cir_4 = Circle(Plane=pl, Radius=Slider(10, range=0..100))
panel_7 = Panel("毛を生やすやつ")
neg_3 = Negative(Value=multiplication_2)
extr_5 = Extrude(Base=cir_4, Direction=multiplication_2)
cir_5 = Circle(Plane=pl_2, Radius=Slider(18, range=0..100))
division_3 = Division(A=neg_3, B=2)
number_slider_13 = Slider(60, range=0..100)
cap_5 = CapHoles(Brep=extr_5)
bbox = BoundingBox(Content=data_3, Plane=PlaneXY(0, 0, 0))  # -> Box, Box_2
bass_params = GhPythonScript(
    Nozzle_Diameter=0.3,
    Layer_Height=0.2,
    Top_Solid_Layers=2,
    Bottom_Solid_Layers=2,
    Num_of_Shell=2,
    Infill_Ratio=25,
    Artifact_Shell=2,
    Temp_Nozzle=195,
    Temp_Bed=0)  # -> out, params
# ---------- bass_params: Python ----------
__author__ = "m0rya"

import rhinoscriptsyntax as rs
import ghpythonlib.treehelpers as th
import Rhino

layerTree = []

layerTree.append(["nozzle diameter", Nozzle_Diameter])
layerTree.append(["layer height", Layer_Height])
layerTree.append(["top solid layers", Top_Solid_Layers])
layerTree.append(["bottom solid layers", Bottom_Solid_Layers])
layerTree.append(["num of shell", Num_of_Shell])
layerTree.append(["infill pitch", Infill_Ratio])
layerTree.append(["num of artifacts shells", Artifact_Shell])
layerTree.append(["Temp_Nozzle", Temp_Nozzle])
layerTree.append(["Temp_Bed", Temp_Bed])

layerTree = th.list_to_tree(layerTree, source=[0])
params = layerTree
# ---------- end bass_params ----------
multiplication_3 = Multiplication(A=evalsrf_2.Normal, B=Slider(32, range=0..100))
move_6 = Move(Geometry=cap_5, Motion=division_3)  # -> Geometry, Transform
extr_6 = Extrude(Base=cir_5, Direction=multiplication_3)
unset_18 = RemoteSender(bbox.Box)
# build base slice layer
unset_19 = RemoteSender(mesh_4)
division_4 = Division(A=multiplication_3, B=2)
vec_6 = VectorXYZ(XComponent=number_slider_13, YComponent=number_slider_13, ZComponent=0)  # -> Vector, Length
move_7 = Move(Geometry=sdiff, Motion=vec_6.Vector)  # -> Geometry, Transform
data_4 = Data(move_6.Geometry)
move_8 = Move(Geometry=data_4, Motion=vec_6.Vector)  # -> Geometry, Transform
neg_4 = Negative(Value=division_4)
merge_4 = Merge(Data1=graft(unset_17), Data2=graft(unset_16))
data_5 = Data(data_3)
panel_8 = Panel(bass_params.params)
unset_20 = RemoteSender(merge_4)
move_9 = Move(Geometry=extr_6, Motion=neg_4)  # -> Geometry, Transform
bass_slicer = BassSlicer(data_2=mesh_3, data=bass_params.params)  # -> data_6, crv_2
panel_10 = Panel(merge_4)
cap_6 = CapHoles(Brep=move_9.Geometry)
panel_11 = Panel("shell複数に対応してない")
panel_12 = Panel("Build Shell")
panel_13 = Panel("offsetにめちゃ時間かかる")
unset_21 = RemoteSender(bass_slicer.crv_2)
panel_14 = Panel("""[n;0]
G-Code
G-Code
…

[n;1]
Path
Path
…""")
crv = Curve(bass_slicer.crv_2)
data_6 = Data(unset_19)
unset_22 = RemoteSender(bass_slicer.data_6)
data_7 = Data(unset_19)
# length of Hair
# 
# Horizontal Interval
# 
# Vertical Interval
hair_params = GhPythonScript(Length_of_Hair=40, Horizontal_Interval=2, Vertical_Interval=5, Thickness_Hair=0.6)  # -> params
# ---------- hair_params: Python ----------
__author__ = "m0rya"

import rhinoscriptsyntax as rs

params = [Length_of_Hair, Horizontal_Interval, Vertical_Interval, Thickness_Hair]
# ---------- end hair_params ----------
crv_2 = Curve(unset_21)
fakewave_params = GhPythonScript(Pitch_of_Wave=3.5, Height_of_Wave=2.5, Pitch_of_Z=10)  # -> params
# ---------- fakewave_params: Python ----------
__author__ = "m0rya"

import rhinoscriptsyntax as rs


params = [Pitch_of_Wave, Height_of_Wave, Pitch_of_Z]
# ---------- end fakewave_params ----------
boa_params = GhPythonScript(Height=10, E_Speed=300, Multiplier_E=1.5)  # -> params
# ---------- boa_params: Python ----------
__author__ = "m0rya"

import rhinoscriptsyntax as rs


params = [Height, E_Speed, Multiplier_E]
# ---------- end boa_params ----------
panel_15 = Panel("""Additionalにどうパラメータ付けて、G-Codeに落とすか問題

どうUniteするか問題

FGAMの接合部問題""")
remote_receiver_16 = RemoteReceiver(unset_8)
remote_receiver_17 = RemoteReceiver(unset_11)
remote_receiver_18 = RemoteReceiver(unset_22)
data_8 = Data(unset_19)
panel_16 = Panel("nE前に吐出するようにする")
data_9 = Data(unset_19)
crv_3 = Curve(unset_21)
# Ad Sliceにパラメータをもたせる
# 
# パラメータを持ったAd SliceとBase SliceをUniteする
# 
# UniteされたパスをG-Codeとして書き出し。
panel_17 = Panel("割合の設定をもっといろいろできるようにする")
fgam_ad_slicer = FGAMAdSlicer(mesh=data_8, crv=bass_slicer.crv_2, N=remote_receiver_16, num=remote_receiver_17, data=data_5, vec=remote_receiver_18)  # -> a, crv_6, a_2; disabled
fakeweave_ad_slicer = FakeWeaveAdSlicer(mesh=data_6, crv=crv, D=fakewave_params)  # -> C, a
onoff = EnableDisableObject(Enabled=Toggle(True), AllObjects_Object=hair_ad_slicer)
onoff_2 = EnableDisableObject(Enabled=Toggle(True), AllObjects_Object=boa_ad_slicer)
boa_ad_slicer = BOAAdSlicer(mesh=data_9, crv=crv_3, params=boa_params)  # -> R, R_2
onoff_3 = EnableDisableObject(Enabled=Toggle(True), AllObjects_Object=fakeweave_ad_slicer)
hair_ad_slicer = HairAdSlicer(mesh=data_7, crv=crv_2, data=hair_params)  # -> R_2, R, crv_8
unset_23 = RemoteSender(fgam_ad_slicer.crv_6)
data_10 = Data(fgam_ad_slicer.a_2)
panel_18 = Panel("やっぱりArtifact必須な気がする")
remote_receiver_19 = RemoteReceiver(unset_8)  # disabled
remote_receiver_20 = RemoteReceiver(unset_14)  # disabled
remote_receiver_21 = RemoteReceiver(unset_22)  # disabled
remote_receiver_22 = RemoteReceiver(unset_12)  # disabled
box_4 = Box(bbox.Box)  # disabled
remote_receiver_23 = RemoteReceiver(unset_8)  # disabled
remote_receiver_24 = RemoteReceiver(unset_11)  # disabled
remote_receiver_25 = RemoteReceiver(unset_15)  # disabled
remote_receiver_26 = RemoteReceiver(unset_22)  # disabled
remote_receiver_27 = RemoteReceiver(unset_13)  # disabled
crv_4 = Curve(fakeweave_ad_slicer.C)
box_5 = Box(bbox.Box)  # disabled
remote_receiver_28 = RemoteReceiver(graft(unset_22))  # disabled
data_11 = Data(fakeweave_ad_slicer.a)
remote_receiver_29 = RemoteReceiver(unset_8)  # disabled
remote_receiver_30 = RemoteReceiver(unset_15)  # disabled
box_6 = Box(bbox.Box)  # disabled
cluster_2 = Cluster(B=box_4, D=remote_receiver_22, N=remote_receiver_19, C=remote_receiver_20, vec=remote_receiver_21)  # disabled
panel_19 = Panel("Building Artifacts")  # disabled
crv_5 = Curve(boa_ad_slicer.R)
crv_6 = Curve(hair_ad_slicer.crv_8)
data_12 = Data(boa_ad_slicer.R_2)
panel_20 = Panel("BUILDING INFILL")  # disabled
panel_21 = Panel("BUILDING SOLID")  # disabled
cluster_3 = Cluster_2(A_2=remote_receiver_23, A=remote_receiver_24, x=remote_receiver_25, B=box_5, F=remote_receiver_26, N=remote_receiver_27)  # -> a, A_4; disabled
cluster_4 = Cluster_3(num=remote_receiver_29, B=box_6, T=remote_receiver_28, D=remote_receiver_30)  # disabled
crv_7 = Curve(hair_ad_slicer.R_2)
data_13 = Data(hair_ad_slicer.R)
panel_22 = Panel("Unite Pathes")
crv_8 = Curve(cluster_2)  # disabled
panel_23 = Panel("Infill")  # disabled
python = PythonScript(x=cluster_3.A_4)  # -> out, a; disabled
# ---------- python: Python ----------
__author__ = "m0rya"

import rhinoscriptsyntax as rs

if x == None:
	a = None
# ---------- end python ----------
remote_receiver_31 = RemoteReceiver(unset_20)
crv_9 = Curve(cluster_3.a)  # disabled
panel_24 = Panel("Solid Layer FIll")  # disabled
crv_10 = Curve(cluster_4)  # disabled
panel_25 = Panel("BaseからAd-Crvの取り除き")
cluster_5 = Cluster_7()  # -> panel_3, panel_4
python_2 = PythonScript(x=crv_9)  # -> out, a; disabled; same code as python
data_14 = Data(fgam_ad_slicer.a)
toggle = BooleanToggle(True)
data_15 = Data(data_12)
crv_11 = Curve(crv_5)

data_16 = Data(data_13)
crv_12 = Curve(crv_7)

python_3 = GhPythonScript(button=Toggle(False), initGCode=cluster_5.panel_3, endGCode=cluster_5.panel_4, info=data_14, params=remote_receiver_31)  # -> out, debug; inputs initGCode: list, endGCode: list, path: tree, info: tree, params: tree; disabled
# ---------- python_3: Python ----------
__author__ = "m0rya"

import rhinoscriptsyntax as rs
import datetime



class GCoder:
    
    def __init__(self):
        
        print("hello")

    def parseParams(self, params):
        self.nozzleDiameter = params.Branch(0)[1]
        self.layerHeight = params.Branch(1)[1]
        self.topSolidLayer = params.Branch(2)[1]
        self.bottomSolidLayer = params.Branch(3)[1]
        self.numOfShell = params.Branch(4)[1]
        self.pitchOfInfill = params.Branch(5)[1]
        self.numOfArtifactShell = params.Branch(6)[1]
        self.distOfArtifact = params.Branch(7)[1]
        
        self.initE = "G92 E0\n"
        self.eSpeed = 500
        self.mSpeed = 1000
        self.retractValue = 0
        self.firstLayerRatio = 0.2
        
    def calc_e(self, dist):
        multiplier = 0.9
        filamentDia = 1.75
        
        resultE = multiplier * (dist * self.layerHeight * self.nozzleDiameter) / (3.14 * (filamentDia/2.0) * (filamentDia/2.0))
  
        return resultE
        
        
        

       
    def initFile(self,initGCode):
        
        savePath = rs.SaveFileName("Export G-Code File", "G-Code Files (*.gcode) |*.gcode||")
        self.f = open(savePath, 'w')
        
        
        #write basic info
        self.f.write("; This G-Code is generated by Ryoma Takamori's Tool\n")
        
        #write comment
        self.f.write("; Comment\n")
        comment = rs.StringBox()
        self.f.write(": " + comment + "\n")
        self.f.write(";\n")
        
        
        #write date
        dateCode = "; date : {0}\n".format(datetime.datetime.today())
        self.f.write(dateCode)
        
        #write init G-Code
        self.f.writelines('\n'.join(initGCode))
        self.f.write('\n')
        
        
        
    def closeFile(self, endGCode):
        
        self.f.writelines('\n'.join(endGCode))
        self.f.write('\n')
        self.f.close()
        
        
        
        
    def writePath(self, info):
        
        for i in range(int(info.BranchCount/2)):
            
            gInfo = info.Branch(i*2)
            gPath = info.Branch(i*2+1)
            
            
            #move z layer
            self.f.write(self.initE)
            e_value = 0
            
            self.f.write("; layer {0}\n".format(i))
            moveZ = "G0 Z{0}\n".format(self.layerHeight*0.2 + self.layerHeight*i)
            self.f.write(moveZ)
            
            
            
            for j in range(len(gInfo)):
                
                
                #G-Codeがある
                if gInfo[j]:
                    self.f.write(gInfo[j])
                    
                #G-Codeがない
                else:
                    
                    for itr, p in enumerate(gPath):
                        
                        if rs.IsCurveLinear(p):
                            explodedPath = [p]
                            
                        else:
                            explodedPath = rs.ExplodeCurves(p)
        
                        
                        for itr2, crv in enumerate(explodedPath):
                            crv_length = rs.CurveLength(crv)
                            tmp_e_value = self.calc_e(crv_length)
                    
                            start = rs.CurveStartPoint(crv)
                            end = rs.CurveEndPoint(crv)
                    
                            #G0
                            if itr2 == 0:
                                retractG = "G1 E{0}\n".format(e_value-self.retractValue)
                                self.f.write(retractG)
                                
                        
                                moveG = "G0 X{0} Y{1} F{2}\n".format(start.X, start.Y, self.mSpeed)
                                self.f.write(moveG)
                            
                                retractG = "G1 E{0}\n".format(e_value)
                                self.f.write(retractG)
                            
                    
                    
                            #G1
                            e_value += tmp_e_value
                            extrudeG = "G1 X{0} Y{1} E{2} F{3}\n".format(end.X, end.Y, e_value, self.eSpeed)
                            self.f.write(extrudeG)
                            current_pos = end
                            
                            
            
        
        
        
        
        
        
def main():
    
    gcoder = GCoder()
    
    gcoder.parseParams(params)
    
    gcoder.initFile(initGCode)
    
    gcoder.writePath(info)
    
    gcoder.closeFile(endGCode)
    
    
   
    
if button:
    main()
# ---------- end python_3 ----------
python_4 = GhPythonScript(button=Button(), params=bass_params.params, path=crv_4, path_info=data_11)  # -> out, debug; inputs params: tree, path: tree, path_info: tree
# ---------- python_4: Python ----------
__author__ = "m0rya"

import rhinoscriptsyntax as rs
import datetime



class GCoder:
    
    def __init__(self):
        
        print("hello")

    def parseParams(self, params):
        self.nozzleDiameter = params.Branch(0)[1]
        self.layerHeight = params.Branch(1)[1]
        self.topSolidLayer = params.Branch(2)[1]
        self.bottomSolidLayer = params.Branch(3)[1]
        self.numOfShell = params.Branch(4)[1]
        self.pitchOfInfill = params.Branch(5)[1]
        self.numOfArtifactShell = params.Branch(6)[1]
        #self.distOfArtifact = params.Branch(7)[1]
        self.temp_bed = params.Branch(8)[1]
        self.temp_nozzle = params.Branch(7)[1]
        
        self.initE = "G92 E0\n"
        self.eSpeed = 500
        self.mSpeed = 1000
        self.retractValue = 0
        self.firstLayerRatio = 0.2
        
    def calc_e(self, dist):
        multiplier = 0.9
        filamentDia = 1.75
        
        resultE = multiplier * (dist * self.layerHeight * self.nozzleDiameter) / (3.14 * (filamentDia/2.0) * (filamentDia/2.0))
  
        return resultE
        
        
        

       
    def initFile(self):
        
        savePath = rs.SaveFileName("Export G-Code File", "G-Code Files (*.gcode) |*.gcode||")
        self.f = open(savePath, 'w')
        
        
        #write basic info
        self.f.write("; This G-Code is generated by Ryoma Takamori's Tool\n")
        
        #write comment
        self.f.write("; Comment\n")
        comment = rs.StringBox()
        self.f.write(": " + comment + "\n")
        self.f.write(";\n")
        
        
        #write date
        dateCode = "; date : {0}\n".format(datetime.datetime.today())
        self.f.write(dateCode)
        
        #write init G-Code
        
        initGCode = "; initial G-Code\n"
        initGCode += "G90\n"
        initGCode += "M82\n"
        initGCode += "G92 E0.0\n"
        initGCode += "G28 X0.0 Y0.0 Z0.0\n"
        initGCode += "G1 Z10.0 F30000.0\n"
        initGCode += "M106 P0 S255\n"
        initGCode += "M190 S{0}\n".format(self.temp_bed)
        initGCode += "M109 S{0}\n".format(self.temp_nozzle)
        

        self.f.writelines(initGCode)
        self.f.write('\n')
        
        
        
    def closeFile(self):
        
        endGCode = "; End G-Code\n"
        endGCode += "M140 S0.0\n"
        endGCode += "M104 S0.0\n"
        endGCode += "M106 S0.0\n"
        endGCode += "M84\n"
        
        self.f.writelines(endGCode)
        self.f.write('\n')
        self.f.close()
        
    def crv2gcode(self, crv):
        
        gcode = []
        
        gcode.append("G92 E0\n")
        e_value = 0
        
        if rs.IsCurveLinear(crv):
            exploded = [crv]
            
        else:
            exploded = rs.ExplodeCurves(crv)
            
            
        for itr, e in enumerate(exploded):
            
            crv_length = rs.CurveLength(e)
            tmp_e_value = self.calc_e(crv_length)
            
            start = rs.CurveStartPoint(e)
            end = rs.CurveEndPoint(e)
            
            #G0
            if itr == 0:
                gcode.append("G1 E{0}\n".format(e_value - self.retractValue))
                gcode.append("G0 X{0} Y{1} F{2}\n".format(start.X, start.Y, self.mSpeed))
                gcode.append("G1 E{0}\n".format(e_value))
        
            #G1
            e_value += tmp_e_value
            gcode.append("G1 X{0} Y{1} E{2} F{3}\n".format(end.X, end.Y, e_value, self.eSpeed))
        
        
        
        
        return ''.join(gcode)
        
        
        
    '''
    def writePath(self, path, path_info):
        
        
        
        self.f.write("; shell\n")
        e_value = 0
        
        current_pos = rs.AddPoint(0,0,0)
        
        #each layer
        for i in range(path.BranchCount):
            self.f.write(self.initE)
            e_value = 0
            
            paths = path.Branch(i)
            params = path_info.Branch(i)
            
            
            #move Z
            self.f.write("; layer {0}\n".format(i))
            moveZ = "G0 Z{0}\n".format(self.layerHeight*0.2 + self.layerHeight*i)
            self.f.write(moveZ)
            
            
            #each path
            for itr,p in enumerate(paths):
                exploded = rs.ExplodeCurves(p)
                
                #param g-code
                if params[itr]:
                    #parsedParam = params[itr].split(',')
                    #if parsedParam[0] == "FGAM":
                    #    ratioCode = "M567 P0 E{0[1]}:{0[2]}:{0[3]}:{0[4]}\n".format(parsedParam)
                    #    self.f.write(ratioCode)
                    self.f.write(params[itr])
                    e_value = 0
                    
                        
                  
                else:
                    
                    #be changed
                    normalRatio = [0.9, 0.1, 0.0, 0.0]
                    ratioCode = "M567 P0 E{0[0]}:{0[1]}:{0[2]}:{0[3]}\n".format(normalRatio)
                    self.f.write(ratioCode)
                    
                    
                
                    #curve g-code
                    for itr2, crv in enumerate(exploded):
                        crv_length = rs.CurveLength(crv)
                        tmp_e_value = self.calc_e(crv_length)
                    
                        start = rs.CurveStartPoint(crv)
                        end = rs.CurveEndPoint(crv)
                    
                        #G0
                        if rs.Distance(current_pos, start) > 0.01:
                            retractG = "G1 E{0}\n".format(e_value-self.retractValue)
                            self.f.write(retractG)
                            
                        
                            moveG = "G0 X{0} Y{1} F{2}\n".format(start.X, start.Y, self.mSpeed)
                            self.f.write(moveG)
                            
                            retractG = "G1 E{0}\n".format(e_value)
                            self.f.write(retractG)
                            
                    
                    
                        #G1
                        e_value += tmp_e_value
                        extrudeG = "G1 X{0} Y{1} E{2} F{3}\n".format(end.X, end.Y, e_value, self.eSpeed)
                        self.f.write(extrudeG)
                        current_pos = end
                            
                            
            
    '''
    
    def writePath(self, path, path_info):
        
        
        #layer
        for i in range(path.BranchCount):
            
            #move Z
            self.f.write("; layer {0}\n".format(i))
            moveZ = "G0 Z{0}\n".format(self.layerHeight*0.2 + self.layerHeight*i)
            self.f.write(moveZ)
            
            
            
            for itr, c in enumerate(path.Branch(i)):
                
                
                #path_info あり
                if path_info.Branch(i)[itr]:
                    
                    self.f.write(path_info.Branch(i)[itr])
                    
                #path_infoないのでスライス
                else:
                    
                    self.f.write(self.crv2gcode(c))
        
        
        
        
        
def main():
    
    gcoder = GCoder()
    
    gcoder.parseParams(params)
    
    gcoder.initFile()
    
    gcoder.writePath(path, path_info)
    
    gcoder.closeFile()
    
    
   
    
if button:
    main()
# ---------- end python_4 ----------
panel_26 = Panel("""Ad-Sliceの場所が一部分だから現行のものでいけるが、複数になった場合、パスの順番を考えないといけない。

その場合、CrvDomainを使って並び替えるなりすればいけるはず。""")
panel_27 = Panel("Ad-Sliceの掛け合わせはまた、今度考えることに使用。")
panel_28 = Panel("curve domainをうまく使えば並び替えられるのでは")
panel_29 = Panel("FGAMを狙った割合で")
panel_30 = Panel("BOAかFake網目のAd-Slicer")
panel_31 = Panel("複数のAd-Sliceをどうつなげるか問題")
panel_32 = Panel(python_4.out)
panel_33 = Panel(python_3.out)

panel_34 = Panel("Artifacts")  # disabled
panel_35 = Panel("Shell")  # disabled
panel_36 = Panel("Solid Fill")  # disabled
crv_13 = Curve(simplify(crv_8))  # disabled
crv_14 = Curve(bass_slicer.crv_2)  # disabled
crv_15 = Curve(crv_10)  # disabled
crv_16 = Curve(crv_9)  # disabled

remote_receiver_32 = RemoteReceiver(flatten(unset_23))
remote_receiver_33 = RemoteReceiver(unset_21)
remote_receiver_34 = RemoteReceiver(unset_19)
cluster_6 = Cluster_6(crv=remote_receiver_33, data=remote_receiver_34)
crv_17 = Curve(remote_receiver_32)
crv_18 = Curve(cluster_6)
crv_19 = Curve(flatten(crv_18))
crv_20 = Curve(remote_receiver_32)
preview = CustomPreview(Geometry=crv_19, Material=ColourSwatch(SwatchColor=RGB(55, 242, 255)))
preview_2 = CustomPreview(Geometry=crv_20, Material=ColourSwatch(SwatchColor=RGB(251, 112, 255)))

panel_38 = Panel("Preview")
explode = Explode(Curve=crv_14, Recursive=True)  # -> Segments, Vertices; disabled
unset_24 = RemoteSender(crv_16)  # disabled
explode_2 = Explode(Curve=crv_13, Recursive=True)  # -> Segments, Vertices; disabled
unset_25 = RemoteSender(crv_15)  # disabled
trim = TrimTree(Tree=explode.Segments, Depth=1)  # disabled
trim_2 = TrimTree(Tree=explode_2.Segments, Depth=1)  # disabled
crv_21 = Curve(trim)  # disabled
crv_22 = Curve(trim_2)  # disabled

panel_39 = Panel("""; initial G-Code
G90
M82
G92 E0.000
G28 X0.000 Y0.000 Z0.000
G1 Z10.000 F3000.000
M106 P0 S255
M190 S0
M109 S195""")
panel_40 = Panel("""; End G-Code
; z+5
M140 S0.0
M104 S0.0
M106 S0.0
M84""")

unset_26 = RemoteSender(crv_21)  # disabled
unset_27 = RemoteSender(crv_22)  # disabled

crv_23 = Curve(trim)  # disabled

crv_24 = Curve(crv_15)  # disabled

crv_25 = Curve(crv_16)  # disabled

crv_26 = Curve(trim_2)  # disabled

# ----
# TO DO
# 
# Gradation Preview
# Curve Divide
# 
# How grad
panel_45 = Panel("""TO DO

グラデーションのプレビュー機能をつける""")

number_slider_14 = Slider(0.9, range=0..1)  # disabled
number_slider_15 = Slider(0.1, range=0..1)  # disabled
dom_4 = ConstructDomain(DomainStart=number_slider_14, DomainEnd=number_slider_15)  # disabled

remote_receiver_35 = RemoteReceiver(unset_26)  # disabled
crv_27 = Curve(crv_16)  # disabled
python_5 = PythonScript(x=crv_27)  # -> out, a; disabled
# ---------- python_5: Python ----------
__author__ = "m0rya"

import rhinoscriptsyntax as rs

if x != None:
	a = rs.AddPoint((0.9,0.1,0.0))
else:
	a = None
# ---------- end python_5 ----------
python_6 = PythonScript(x=remote_receiver_35)  # -> out, a; disabled
# ---------- python_6: Python ----------
__author__ = "m0rya"

import rhinoscriptsyntax as rs

a = rs.AddPoint((0.8,0.2,0.0))
# ---------- end python_6 ----------
vec_7 = Vector(python_6.a)  # disabled
vec_8 = Vector(python_5.a)  # disabled
viewer = ParamViewer(vec_8)  # disabled
remote_receiver_36 = RemoteReceiver(unset_17)  # disabled
remote_receiver_37 = RemoteReceiver(unset_16)  # disabled

panel_46 = Panel("""; initial G-Code
G90
M82
G92 E0.000
G28 X0.000 Y0.000 Z0.000
G1 Z10.000 F3000.000
M190 S0
M109 S195""")  # disabled
panel_47 = Panel("""; End G-Code
; z+5
M140 S0.0
M104 S0.0
M106 S0.0
M84""")  # disabled
merge_5 = Merge(Data1=graft(remote_receiver_36), Data2=graft(remote_receiver_37))  # disabled

# ----
# Curve To Line_Like Curve
number_slider_16 = Slider(20, range=0..100)  # disabled
crv_28 = Curve([<curve referenced from the Rhino model> x4])  # disabled
cls = Closed(Curve=crv_28)  # -> Closed, Periodic; disabled
explode_3 = Explode(Curve=crv_28, Recursive=True)  # -> Segments, Vertices; disabled
divide = DivideCurve(Curve=explode_3.Segments, Count=number_slider_16, Kinks=False)  # -> Points, Tangents, Parameters; disabled
pline = PolyLine(Vertices=divide.Points, Closed=cls.Closed)  # disabled

toggle_2 = BooleanToggle(True)  # disabled
button = Button()  # disabled
remote_receiver_38 = RemoteReceiver(unset_25)  # disabled
remote_receiver_39 = RemoteReceiver(unset_27)  # disabled
remote_receiver_40 = RemoteReceiver(unset_26)  # disabled
remote_receiver_41 = RemoteReceiver(unset_24)  # disabled
remote_receiver_42 = RemoteReceiver(unset_10)  # disabled
panel_48 = Panel("リトラクトがよくないかも？")  # disabled
panel_49 = Panel(remote_receiver_40)  # disabled
panel_50 = Panel("Preview")  # disabled

swatch = ColourSwatch(SwatchColor=RGB(0, 0, 0))  # disabled
swatch_2 = ColourSwatch(SwatchColor=RGB(0, 255, 21))  # disabled
swatch_3 = ColourSwatch(SwatchColor=RGB(6, 75, 128))  # disabled
swatch_4 = ColourSwatch(SwatchColor=RGB(255, 255, 34))  # disabled

# ----
# make ratio from curve z
panel_51 = Panel("1次元的なグラデーション")  # disabled
panel_52 = Panel("bounding box")  # disabled
remote_receiver_43 = RemoteReceiver(unset_18)  # disabled
debox = DeconstructBox(Box=remote_receiver_43)  # -> Plane, X, Y, Z; disabled
unset_28 = RemoteSender(dom_4)  # disabled
remote_receiver_44 = RemoteReceiver(unset_28)  # disabled

cluster_7 = Cluster_4(S=debox.Z, T=remote_receiver_44, L=crv_23)  # disabled
cluster_8 = Cluster_4(S=debox.Z, T=remote_receiver_44, L=crv_24)  # disabled
cluster_9 = Cluster_4(S=debox.Z, T=remote_receiver_44, L=crv_25)  # disabled
cluster_10 = Cluster_4(S=debox.Z, T=remote_receiver_44, L=crv_26)  # disabled

vec_9 = Vector(cluster_7)  # disabled
vec_10 = Vector(cluster_8)  # disabled
vec_11 = Vector(cluster_9)  # disabled
vec_12 = Vector(cluster_10)  # disabled

panel_53 = Panel("solid ratio")  # disabled
panel_54 = Panel("infill ratio")  # disabled
panel_55 = Panel("shell ratio")  # disabled
panel_56 = Panel("artifact ratio")  # disabled
data_17 = Data(vec_9)  # disabled
data_18 = Data(vec_12)  # disabled
data_19 = Data(vec_10)  # disabled
data_20 = Data(vec_11)  # disabled

unset_29 = RemoteSender(data_20)  # disabled
unset_30 = RemoteSender(data_18)  # disabled
unset_31 = RemoteSender(data_17)  # disabled
unset_32 = RemoteSender(data_19)  # disabled
item = ListItem(List=unset_31, Index=0, Wrap=True)  # disabled
remote_receiver_45 = RemoteReceiver(unset_31)  # disabled
remote_receiver_46 = RemoteReceiver(unset_32)  # disabled
remote_receiver_47 = RemoteReceiver(unset_29)  # disabled
remote_receiver_48 = RemoteReceiver(unset_30)  # disabled
# file export python script
python_7 = PythonScript(
    button=button,
    initG=panel_46,
    endG=panel_47,
    layerH=remote_receiver_42,
    params=merge_5,
    shell=remote_receiver_40,
    shell_ratio=remote_receiver_45,
    solid=remote_receiver_38,
    solid_ratio=remote_receiver_46,
    infill=remote_receiver_41,
    infill_ratio=remote_receiver_47,
    artifact=remote_receiver_39,
    artifact_ratio=remote_receiver_48,
    x=item)  # -> out, a; inputs initG: list, endG: list, params: tree, shell: tree, shell_ratio: tree, solid: tree, solid_ratio: tree, infill: tree, infill_ratio: tree, artifact: tree, artifact_ratio: tree, x: tree; disabled
# ---------- python_7: Python ----------
__author__ = "m0rya"

import rhinoscriptsyntax as rs
import datetime

'''
paras
'''

eSpeed = 500
mSpeed = 1000
retract_value = 0
firstLayerRatio = 0.2
initE = "G92 E0\n"


def calc_e(layerHeight, dist):
	multiplier = 1.4
	extrusionDiameter = 0.35
	filamentDiameter = 1.75

	resultE = multiplier * (dist * layerHeight * extrusionDiameter) / (3.14 * (filamentDiameter/2.0) * (filamentDiameter/2.0))
	return resultE

def calcRatio(ratio):
	resultRatio = [ratio[0], ratio[1], ratio[2]]
	resultRatio.append(1.0 - sum(resultRatio))
	ratioCode = "M567 P0 E{0[0]}:{0[1]}:{0[2]}:{0[3]}\n".format(resultRatio)
	return ratioCode
	
	



def writeShell(f, itr):


	#Shell G-Code

	f.write("; shell\n")

	#init
	f.write(initE)
	e_value = 0

	for j in range(len(shell.Branch(itr))):
		crv = shell.Branch(itr)[j]
		crv_length = rs.CurveLength(crv)
		#e_value += calc_e(layerH, crv_length)
		tmp_e_value = calc_e(layerH, crv_length)

		#may change
		start = rs.CurveStartPoint(crv)
		end = rs.CurveEndPoint(crv)

		#ratio code
		ratioCode = calcRatio(shell_ratio.Branch(itr)[j])
		f.write(ratioCode)
		

		#G0
		if j == 0:
			retractG = "G1 E{0}\n".format(e_value-retract_value)
			f.write(retractG)

			moveG = "G0 X{0} Y{1} F{2}\n".format(start.X, start.Y, mSpeed)
			f.write(moveG)	
			
			retractG = "G1 E{0}\n".format(e_value)
			f.write(retractG)

		else:
			moveG = "G0 X{0} Y{1} F{2}\n".format(start.X, start.Y, mSpeed)
			f.write(moveG)

			
		
		#G1
		e_value += tmp_e_value
		extrudeG = "G1 X{0} Y{1} E{2} F{3}\n".format(end.X, end.Y, e_value, eSpeed)
		f.write(extrudeG)



def writeSolid(f, itr):

	f.write("; solid fill\n")
	f.write(initE)
	e_value = 0

	for j in range(len(solid.Branch(itr))):
		if solid.Branch(itr)[j] == None:
			continue
		else:
			crv = solid.Branch(itr)[j]

		crv_length = rs.CurveLength(crv)
		#e_value += calc_e(layerH, crv_length)
		tmp_e_value = calc_e(layerH, crv_length)

		#may change
		start = rs.CurveStartPoint(crv)
		end = rs.CurveEndPoint(crv)

		#ratio code
		ratio = solid_ratio.Branch(itr)[j]
		ratio = [ratio[0], ratio[1], ratio[2]]
		ratio.append(1.0 - sum(ratio))
		ratioCode = "M567 P0 E{0}:{1}:{2}:{3}\n".format(ratio[0], ratio[1], ratio[2], ratio[3])
		f.write(ratioCode)

		#G0
		if j == 0:
			retractG = "G1 E{0}\n".format(e_value - retract_value)
			f.write(retractG)
		
			moveG = "G0 X{0} Y{1} F{2}\n".format(start.X, start.Y, mSpeed)
			f.write(moveG)

			retractG = "G1 E{0}\n".format(e_value)
			f.write(retractG)

		elif j %2 == 0:
			moveG = "G0 X{0} Y{1} F{2}\n".format(start.X, start.Y, mSpeed)
			f.write(moveG)

		else:
			moveG = "G0 X{0} Y{1} F{2}\n".format(end.X, end.Y, mSpeed)
			f.write(moveG)
			
		
		#G1
		e_value += tmp_e_value
		if j%2 == 0:
			extrudeG = "G1 X{0} Y{1} E{2} F{3}\n".format(end.X, end.Y, e_value, eSpeed)
		else:
			extrudeG = "G1 X{0} Y{1} E{2} F{3}\n".format(start.X, start.Y, e_value, eSpeed)
		f.write(extrudeG)
			

def writeInfill(f, itr):
	f.write("; infill\n")
	f.write(initE)
	e_value = 0

	for j in range(len(infill.Branch(itr))):
		if infill.Branch(itr)[j] == None:
			continue
		else:
			crv = infill.Branch(itr)[j]
		
		crv_length = rs.CurveLength(crv)
		#e_value += calc_e(layerH, crv_length)
		tmp_e_value = calc_e(layerH, crv_length)

		#ratio code

		ratioCode = calcRatio(infill_ratio.Branch(itr)[j])
		f.write(ratioCode)


		#may change
		start = rs.CurveStartPoint(crv)
		end = rs.CurveEndPoint(crv)

	
		
		#G0
		if j == 0:

			retractG = "G1 E{0}\n".format(e_value - retract_value)
			f.write(retractG)
		
			moveG = "G0 X{0} Y{1} F{2}\n".format(start.X, start.Y, mSpeed)
			f.write(moveG)

			retractG = "G1 E{0}\n".format(e_value)
			f.write(retractG)

		elif j%2 == 0:
			moveG = "G0 X{0} Y{1} F{2}\n".format(start.X, start.Y, mSpeed)
			f.write(moveG)

		else:
			moveG = "G0 X{0} Y{1} F{2}\n".format(end.X, end.Y, mSpeed)
			f.write(moveG)

		

		#G1
		e_value += tmp_e_value
		if j%2 == 0:
			extrudeG = "G1 X{0} Y{1} E{2} F{3}\n".format(end.X, end.Y, e_value, eSpeed)

		else:
			extrudeG = "G1 X{0} Y{1} E{2} F{3}\n".format(start.X, start.Y, e_value, eSpeed)

		f.write(extrudeG)

def writeArtifact(f, itr):
	f.write("; Artifact\n")
	f.write(initE)
	e_value = 0

	for j in range(len(artifact.Branch(itr))):
		if artifact.Branch(itr)[j] == None:
			continue
		else:
			crv = artifact.Branch(itr)[j]
		
		crv_length = rs.CurveLength(crv)
		#e_value += calc_e(layerH, crv_length)
		tmp_e_value = calc_e(layerH, crv_length)

		#ratio code
		ratioCode = calcRatio(artifact_ratio.Branch(itr)[j])
		f.write(ratioCode)


		#may change
		start = rs.CurveStartPoint(crv)
		end = rs.CurveEndPoint(crv)

	
		


		#G0
		if j == 0:
			retractG = "G1 E{0}\n".format(e_value-retract_value)
			f.write(retractG)

			moveG = "G0 X{0} Y{1} F{2}\n".format(start.X, start.Y, mSpeed)
			f.write(moveG)	
			
			retractG = "G1 E{0}\n".format(e_value)
			f.write(retractG)

		else:
			moveG = "G0 X{0} Y{1} F{2}\n".format(start.X, start.Y, mSpeed)
			f.write(moveG)

			
		
		#G1
		e_value += tmp_e_value
		extrudeG = "G1 X{0} Y{1} E{2} F{3}\n".format(end.X, end.Y, e_value, eSpeed)
		f.write(extrudeG)


def writeParams(f):
	f.write("; Generated by Ryoma Takamori's Tool\n")
	f.write("; Parameters Info\n")

	for i in range(params.BranchCount):
		paramsCode = "; {0[0]} : {0[1]}\n".format(params.Branch(i))
		f.write(paramsCode)
	f.write(";\n")

	f.write(";Comment\n")
	comment = rs.StringBox()
	f.write(";" + comment + "\n")
	f.write(";\n")
	


'''
Main Function
'''


def main():
	#prepare file

	savePath = rs.SaveFileName("Export G-Code File", "G-Code Files (*.gcode)|*.gcode||")
	f = open(savePath, 'w')
	
	#write information about this G-Code
	writeParams(f)

	dateCode = "; date : {0}\n".format(datetime.datetime.today())
	f.write(dateCode)


	#write initial G-Codes

	f.writelines('\n'.join(initG))
	f.write('\n')
	


	#write main G-Codes


	for i in range(shell.BranchCount):
		f.write(initE)
		e_value = 0
		

		#change layer
		f.write("; layer {0}\n".format(i))
		moveZ = "G0 Z{0}\n".format(layerH*0.2+layerH*i)
		f.write(moveZ)


		#Shell
		writeShell(f, i)


		#Solid fill
		writeSolid(f, i)


		#Infill
		writeInfill(f, i)

		#Artifact
		writeArtifact(f, i)
			
	
	#write end G-Codes
	f.writelines('\n'.join(endG))
	f.write('\n')


	f.close()

	a = savePath





if button:
	main()
# ---------- end python_7 ----------
panel_57 = Panel(python_7.a)  # disabled

panel_58 = Panel("shell")  # disabled
panel_59 = Panel("solid")  # disabled
panel_60 = Panel("infill")  # disabled
panel_61 = Panel("artifact")  # disabled
remote_receiver_49 = RemoteReceiver(unset_26)  # disabled
remote_receiver_50 = RemoteReceiver(unset_31)  # disabled
remote_receiver_51 = RemoteReceiver(unset_32)  # disabled
remote_receiver_52 = RemoteReceiver(unset_24)  # disabled
remote_receiver_53 = RemoteReceiver(unset_29)  # disabled
remote_receiver_54 = RemoteReceiver(unset_27)  # disabled
remote_receiver_55 = RemoteReceiver(unset_30)  # disabled
remote_receiver_56 = RemoteReceiver(unset_25)  # disabled
merge_6 = Merge(Data1=swatch, Data2=swatch_3, Data3=swatch_2, Data4=swatch_4)  # disabled
python_8 = PythonScript(x=remote_receiver_50, y=merge_6)  # -> out, a, b, c; inputs x: tree, y: list; disabled
# ---------- python_8: Python ----------
__author__ = "m0rya"

import rhinoscriptsyntax as rs
import Rhino
import scriptcontext as sc

import clr
clr.AddReference("Grasshopper")
from Grasshopper.Kernel.Data import GH_Path
from Grasshopper import DataTree

resultR = DataTree[object]()
resultG = DataTree[object]()
resultB = DataTree[object]()




for i in range(x.BranchCount):

	tree_path = GH_Path(i)
	if x.Branch(i)[0] == None:
		resultR.Add(None, tree_path)
		resultG.Add(None, tree_path)
		resultB.Add(None, tree_path)
		continue



	for j in range(len(x.Branch(i))):
		
		tmpVec = x.Branch(i)[j]
		tmp = [tmpVec[0], tmpVec[1], tmpVec[2]]

		tmp.append(1.0 - sum(tmp))

		rR = 0
		rG = 0
		rB = 0
		
		for k in range(4):
			rR += y[k].R*tmp[k]
			rG += y[k].G*tmp[k]
			rB += y[k].B*tmp[k]

		'''
		rR /= 4.0
		rG /= 4.0
		rB /= 4.0
		'''

		
		#resultVec = rs.AddPoint(rR, rG, rB)
		
		#resultTree.Add(resultVec, tree_path)
		
		resultR.Add(rR, tree_path)
		resultG.Add(rG, tree_path)
		resultB.Add(rB, tree_path)

		
		

a = resultR
b = resultG
c = resultG
# ---------- end python_8 ----------
python_9 = PythonScript(x=remote_receiver_51, y=merge_6)  # -> out, a, b, c; inputs x: tree, y: list; disabled
# ---------- python_9: Python ----------
__author__ = "m0rya"

import rhinoscriptsyntax as rs
import Rhino
import scriptcontext as sc

import clr
clr.AddReference("Grasshopper")
from Grasshopper.Kernel.Data import GH_Path
from Grasshopper import DataTree

resultR = DataTree[object]()
resultG = DataTree[object]()
resultB = DataTree[object]()




for i in range(x.BranchCount):

	tree_path = GH_Path(i)
	if x.Branch(i)[0] == None:
		resultR.Add(None, tree_path)
		resultG.Add(None, tree_path)
		resultB.Add(None, tree_path)
		continue



	for j in range(len(x.Branch(i))):
		
		tmpVec = x.Branch(i)[j]
		tmp = [tmpVec[0], tmpVec[1], tmpVec[2]]

		tmp.append(1.0 - sum(tmp))

		rR = 0
		rG = 0
		rB = 0
		
		for k in range(4):
			rR += y[k].R*tmp[k]
			rG += y[k].G*tmp[k]
			rB += y[k].B*tmp[k]
		'''
		rR /= 4.0
		rG /= 4.0
		rB /= 4.0
		'''

		
		#resultVec = rs.AddPoint(rR, rG, rB)
		
		#resultTree.Add(resultVec, tree_path)
		
		resultR.Add(rR, tree_path)
		resultG.Add(rG, tree_path)
		resultB.Add(rB, tree_path)

		
		

a = resultR
b = resultG
c = resultG
# ---------- end python_9 ----------
python_10 = PythonScript(x=remote_receiver_53, y=merge_6)  # -> out, a, b, c; inputs x: tree, y: list; disabled
# ---------- python_10: Python ----------
__author__ = "m0rya"

import rhinoscriptsyntax as rs
import Rhino
import scriptcontext as sc

import clr
clr.AddReference("Grasshopper")
from Grasshopper.Kernel.Data import GH_Path
from Grasshopper import DataTree

resultR = DataTree[object]()
resultG = DataTree[object]()
resultB = DataTree[object]()




for i in range(x.BranchCount):

	tree_path = GH_Path(i)
	if x.Branch(i)[0] == None:
		resultR.Add(None, tree_path)
		resultG.Add(None, tree_path)
		resultB.Add(None, tree_path)
		continue



	for j in range(len(x.Branch(i))):
		
		tmpVec = x.Branch(i)[j]
		tmp = [tmpVec[0], tmpVec[1], tmpVec[2]]

		tmp.append(1.0 - sum(tmp))

		rR = 0
		rG = 0
		rB = 0
		
		for k in range(4):
			rR += y[k].R*tmp[k]
			rG += y[k].G*tmp[k]
			rB += y[k].B*tmp[k]

		rR /= 4.0
		rG /= 4.0
		rB /= 4.0

		
		#resultVec = rs.AddPoint(rR, rG, rB)
		
		#resultTree.Add(resultVec, tree_path)
		
		resultR.Add(rR, tree_path)
		resultG.Add(rG, tree_path)
		resultB.Add(rB, tree_path)

		
		

a = resultR
b = resultG
c = resultG
# ---------- end python_10 ----------
python_11 = PythonScript(x=remote_receiver_55, y=merge_6)  # -> out, a, b, c; inputs x: tree, y: list; disabled
# ---------- python_11: Python ----------
__author__ = "m0rya"

import rhinoscriptsyntax as rs
import Rhino
import scriptcontext as sc

import clr
clr.AddReference("Grasshopper")
from Grasshopper.Kernel.Data import GH_Path
from Grasshopper import DataTree

resultR = DataTree[object]()
resultG = DataTree[object]()
resultB = DataTree[object]()




for i in range(x.BranchCount):
	tree_path = GH_Path(i)


	for j in range(len(x.Branch(i))):
		
		tmpVec = x.Branch(i)[j]
		tmp = [tmpVec[0], tmpVec[1], tmpVec[2]]

		tmp.append(1.0 - sum(tmp))

		rR = 0
		rG = 0
		rB = 0
		
		for k in range(4):
			rR += y[k].R*tmp[k]
			rG += y[k].G*tmp[k]
			rB += y[k].B*tmp[k]

		'''
		rR /= 4.0
		rG /= 4.0
		rB /= 4.0
		'''

		
		#resultVec = rs.AddPoint(rR, rG, rB)
		
		#resultTree.Add(resultVec, tree_path)
		
		resultR.Add(rR, tree_path)
		resultG.Add(rG, tree_path)
		resultB.Add(rB, tree_path)

		
		

a = resultR
b = resultG
c = resultG
# ---------- end python_11 ----------
rgb = ColourRGB(Alpha=255, Red=python_8.a, Green=python_8.b, Blue=python_8.c)  # disabled
rgb_2 = ColourRGB(Alpha=255, Red=python_9.a, Green=python_9.b, Blue=python_9.c)  # disabled
rgb_3 = ColourRGB(Alpha=255, Red=python_10.a, Green=python_10.b, Blue=python_10.c)  # disabled
rgb_4 = ColourRGB(Alpha=255, Red=python_11.a, Green=python_11.b, Blue=python_11.c)  # disabled

viewer_2 = ParamViewer(remote_receiver_50)  # disabled
panel_62 = Panel(remote_receiver_51)  # disabled
panel_63 = Panel(rgb_2)  # disabled
panel_64 = Panel(merge_6)  # disabled
preview_3 = CustomPreview(Geometry=remote_receiver_49, Shader=rgb)  # disabled
preview_4 = CustomPreview(Geometry=remote_receiver_56, Shader=rgb_2)  # disabled
preview_5 = CustomPreview(Geometry=remote_receiver_52, Shader=rgb_3)  # disabled
preview_6 = CustomPreview(Geometry=remote_receiver_54, Shader=rgb_4)  # disabled

# ==== cluster Cluster
B = ClusterInput()
N = ClusterInput()
C = ClusterInput()
D = ClusterInput()
vec = ClusterInput()

debox = DeconstructBox(Box=B)  # -> Plane, X, Y, Z
rectangle = Rectangle(Plane=PlaneXY(0, 0, 0), XSize=debox.X, YSize=debox.Y, Radius=0)  # -> Rectangle, Length
series = Series(Start=0, Step=N, Count=C)
offset = Offset(Curve=rectangle.Rectangle, Distance=D, Plane=PlaneXY(0, 0, 0), Corners=1)
neg = Negative(Value=series)
vec_2 = Vector(graft(vec))
offset_2 = Offset(Curve=offset, Distance=neg, Plane=PlaneXY(0, 0, 0), Corners=1)  # -> flatten(Curve)
move = Move(Geometry=offset_2, Motion=vec_2)  # -> Geometry, Transform

G = ClusterOutput(move.Geometry)

# ==== cluster Cluster_2
A = ClusterInput()
panel = Panel("Infill 0の場合を考慮する")
B = ClusterInput()
A_2 = ClusterInput()

subtraction = Subtraction(A=A, B=1)
multiplication = Multiplication(A=A_2, B=subtraction)

N = ClusterInput()
debox = DeconstructBox(Box=B)  # -> Plane, X, Y, Z

domain = Domain(debox.X)
domain_2 = Domain(debox.Y)
dedomain = DeconstructDomain(Domain=domain)  # -> Start, End
dedomain_2 = DeconstructDomain(Domain=domain_2)  # -> Start, End
vec = VectorXYZ(XComponent=dedomain.Start, YComponent=dedomain_2.Start, ZComponent=0)  # -> Vector, Length
vec_2 = VectorXYZ(XComponent=dedomain.Start, YComponent=dedomain_2.End, ZComponent=0)  # -> Vector, Length
ln = Line(StartPoint=vec.Vector, EndPoint=vec_2.Vector)
addition = Addition(A=multiplication, B=N)
X = UnitX(Factor=addition)
move = Move(Geometry=ln, Motion=X)  # -> Geometry, Transform

vec_3 = VectorXYZ(XComponent=dedomain.Start, YComponent=dedomain_2.Start, ZComponent=0)  # -> Vector, Length
vec_4 = VectorXYZ(XComponent=dedomain.End, YComponent=dedomain_2.Start, ZComponent=0)  # -> Vector, Length
ln_2 = Line(StartPoint=vec_3.Vector, EndPoint=vec_4.Vector)
num = Number(domain_2)
division = Division(A=num, B=N)
subtraction_2 = Subtraction(A=division, B="1")
series = Series(Start=0, Step=N, Count=subtraction_2)
Y = UnitY(Factor=series)
F = ClusterInput()
move_2 = Move(Geometry=ln_2, Motion=Y)  # -> Geometry, Transform
A_3 = ClusterInput()
x = ClusterInput()

panel_2 = Panel("init inill line")
num_2 = Number(domain)
division_2 = Division(A=num_2, B=N)
subtraction_3 = Subtraction(A=division_2, B="1")
series_2 = Series(Start=0, Step=N, Count=subtraction_3)
X_2 = UnitX(Factor=series_2)
move_3 = Move(Geometry=move.Geometry, Motion=X_2)  # -> Geometry, Transform
Z = UnitZ(Factor=F)
move_4 = Move(Geometry=flatten(move_3.Geometry), Motion=simplify(graft(Z)))  # -> Geometry, Transform

move_5 = Move(Geometry=flatten(move_2.Geometry), Motion=simplify(graft(Z)))  # -> Geometry, Transform
crv = Curve(move_5.Geometry)

ccx = CurveCurve(CurveA=simplify(A_3), CurveB=crv)  # -> Points, ParamsA, ParamsB
pdecon = Deconstruct(Point=ccx.Points)  # -> XComponent, YComponent, ZComponent
sort = SortList(Keys=pdecon.YComponent, ValuesA=ccx.Points)  # -> Keys, ValuesA
partition = PartitionList(List=sort.ValuesA, Size="2")
pline = PolyLine(Vertices=partition, Closed=False)
trim = TrimTree(Tree=pline, Depth=1)
trim_2 = TrimTree(Tree=trim, Depth=1)

A_4 = ClusterOutput(sort.ValuesA)
python = PythonScript(x=x, y=trim_2)  # -> out, a; inputs x: list, y: tree
# ---------- python: Python ----------
__author__ = "m0rya"

import rhinoscriptsyntax as rs
import Rhino
import scriptcontext as sc

import clr
clr.AddReference("Grasshopper")
from Grasshopper.Kernel.Data import GH_Path
from Grasshopper import DataTree


resultTree = DataTree[object]()

for i in range(y.BranchCount):

	tree_path = GH_Path(i)

	if i < x[0]:
		resultTree.Add(None, tree_path)

	elif i > (y.BranchCount-1-x[1]):
		resultTree.Add(None, tree_path)

	else:

		for j in range(len(y.Branch(i))):
			resultTree.Add(y.Branch(i)[j], tree_path)


a = resultTree
# ---------- end python ----------
python_2 = PythonScript(x=python.a, y=crv)  # -> out, a
# ---------- python_2: Python ----------
__author__ = "m0rya"

import rhinoscriptsyntax as rs

if x == None:
	a = y
else:
	a = x
# ---------- end python_2 ----------
a = ClusterOutput(python_2.a)
panel_3 = Panel(python_2.a)

# ==== cluster Cluster_3
B = ClusterInput()
debox = DeconstructBox(Box=B)  # -> Plane, X, Y, Z
panel = Panel("Building solid layer")
domain = Domain(debox.X)
domain_2 = Domain(debox.Y)
dedomain = DeconstructDomain(Domain=domain_2)  # -> Start, End
dedomain_2 = DeconstructDomain(Domain=domain)  # -> Start, End
vec = VectorXYZ(XComponent=dedomain_2.Start, YComponent=dedomain.End, ZComponent=0)  # -> Vector, Length
vec_2 = VectorXYZ(XComponent=dedomain_2.Start, YComponent=dedomain.Start, ZComponent=0)  # -> Vector, Length
vec_3 = VectorXYZ(XComponent=dedomain_2.End, YComponent=dedomain.Start, ZComponent=0)  # -> Vector, Length
vec_4 = VectorXYZ(XComponent=dedomain_2.End, YComponent=dedomain.End, ZComponent=0)  # -> Vector, Length
num = ClusterInput()
panel_2 = Panel("""Solid Fillのベースとなるカーブ

BBの対角線をベース""")

ln = Line(StartPoint=vec.Vector, EndPoint=vec_3.Vector)
end = EndPoints(Curve=ln)  # -> Start, End
addition = Addition(A=end.Start, B=end.End)
division = Division(A=addition, B=2)
subtraction = Subtraction(A=vec_2.Vector, B=division)
dist = Distance(PointA=vec_2.Vector, PointB=vec_4.Vector)
num_2 = Number(num)
neg = Negative(Value=subtraction)
move = Move(Geometry=ln, Motion=subtraction)  # -> Geometry, Transform
unit = UnitVector(Vector=neg)
division_2 = Division(A=dist, B=num_2)
ext = ExtendCurve(Curve=move.Geometry, Type=0, Start="50", End="50")
series = Series(Start=0, Step=num_2, Count=division_2)
multiplication = Multiplication(A=unit, B=series)
move_2 = Move(Geometry=ext, Motion=multiplication)  # -> Geometry, Transform

panel_3 = Panel("""Solid Fillのベースとなるカーブ

Y軸の一直線""")
multiplication_2 = Multiplication(A=num, B=Slider(0.8, range=0..1))

num_3 = Number(domain)
ln_2 = Line(StartPoint=vec_2.Vector, EndPoint=vec.Vector)
division_3 = Division(A=num_3, B=multiplication_2)
ext_2 = ExtendCurve(Curve=ln_2, Type=0, Start="10", End="10")
series_2 = Series(Start=0, Step=multiplication_2, Count=division_3)
X = UnitX(Factor=1)
multiplication_3 = Multiplication(A=X, B=series_2)
move_3 = Move(Geometry=ext_2, Motion=multiplication_3)  # -> Geometry, Transform

crv = Curve(move_3.Geometry)
crv_2 = Curve(move_2.Geometry)
crv_3 = Curve(crv)
D = ClusterInput()
panel_4 = Panel("Solid Fillの生成")
shell = ClusterInput()
T = ClusterInput()

bang = ExplodeTree(Data=graft(D))  # -> Branch0, Branch1
python = PythonScript(shell=simplify(shell), topNum=bang.Branch0, bottomNum=bang.Branch1)  # -> out, a; inputs shell: tree
# ---------- python: Python ----------
__author__ = "m0rya"

import rhinoscriptsyntax as rs
import Rhino
import scriptcontext as sc

import clr
clr.AddReference("Grasshopper")
from Grasshopper.Kernel.Data import GH_Path
from Grasshopper import DataTree

tree = DataTree[object]()


a = shell.BranchCount

for i in range(shell.BranchCount):
	path = GH_Path(i)

	if i < topNum:
		tree.Add(shell.Branch(i)[0],path)
	elif i > (shell.BranchCount-bottomNum-1):
		tree.Add(shell.Branch(i)[0],path)
	else:	
		tree.Add(None,path)

a = tree
# ---------- end python ----------
xy = XYPlane(Origin=Point(0, 0, 0))
project = Project(Geometry=crv_3, Plane=xy)  # -> Geometry, Transform
project_2 = Project(Geometry=python.a, Plane=xy)  # -> Geometry, Transform
python_2 = PythonScript(solidFill=project.Geometry, shells=project_2.Geometry)  # -> out, a; inputs solidFill: list, shells: tree
# ---------- python_2: Python ----------
__author__ = "m0rya"

import rhinoscriptsyntax as rs
import Rhino

import clr
clr.AddReference("Grasshopper")
from Grasshopper.Kernel.Data import GH_Path
from Grasshopper import DataTree




def trim(boundary, c):
	resultLines = []
	
	try:
		intersectedPoints = rs.CurveCurveIntersection(c, boundary)
	except:
		return None

	if intersectedPoints == None:
		return None

	intersectedPoints = [n[1] for n in intersectedPoints]
	if len(intersectedPoints)%2 == 1:
		return None

	curveParas = []
	for i in intersectedPoints:
		curveParas.append(rs.CurveClosestPoint(c,i))
	
	for i in range(int(len(curveParas)/2)):
		tmp = []
		tmpCurveParas = []
		tmpCurveParas.append(curveParas[i*2])
		tmpCurveParas.append(curveParas[i*2+1])
		
		try:
			tmpCurve = rs.CopyObject(c)	
			resultLines.append(rs.TrimCurve(tmpCurve,tmpCurveParas))
		except:
			continue

	return resultLines

		
		

tree = DataTree[object]()
result = []

for i in range(shells.BranchCount):
	path = GH_Path(i)

	if shells.Branch(i)[0] == None:
		tree.Add(None, path)
		continue

	tmpSolidFill = rs.CopyObjects(solidFill)
	print(tmpSolidFill)

	for j in tmpSolidFill:
	
		lines = trim(shells.Branch(i)[0], j)
		if lines is not None:
			for k in lines:
				tree.Add(k, path)
		
		continue
		

a = tree
# ---------- end python_2 ----------
crv_4 = Curve(python_2.a)
move_4 = Move(Geometry=simplify(crv_4), Motion=simplify(T))  # -> Geometry, Transform

G = ClusterOutput(move_4.Geometry)

# ==== cluster Cluster_4
L = ClusterInput()
panel = Panel("レイヤーのZで割合を決めるやーつ")
item = ListItem(List=L, Index=0, Wrap=True)
end = EndPoints(Curve=item)  # -> Start, End
S = ClusterInput()
pdecon = Deconstruct(Point=end.Start)  # -> XComponent, YComponent, ZComponent
remap = RemapNumbers(Value=pdecon.ZComponent, Source=S, Target=Domain(0, 1))  # -> Mapped, Clipped
graph = GraphMapper(
    remap.Mapped,
    x0=0,
    x1=1,
    y0=0,
    y1=1,
    container_name="Sine",
    Equation_px=[0, 0.5072463751],
    Equation_py=[0, 0.4144924283])
data = Data(graph)
bnd = Bounds(Numbers=flatten(data))
T = ClusterInput()
remap_2 = RemapNumbers(Value=data, Source=bnd, Target=T)  # -> Mapped, Clipped
subtraction = Subtraction(B=remap_2.Mapped)
vec = VectorXYZ(XComponent=remap_2.Mapped, YComponent=subtraction, ZComponent=0)  # -> Vector, Length
lng = ListLength(List=L)
dup = DuplicateData(Data=vec.Vector, Number=lng, Order=True)
D = ClusterOutput(dup)

# ==== cluster Cluster_5
B = ClusterInput()

subtraction = Subtraction(A="4", B=B)
pi = Pi(Factor=1)
sqr = Square(Value=subtraction)
multiplication = Multiplication(A=sqr, B=pi)
multiplication_2 = Multiplication(A=multiplication, B="13")

panel = Panel("円筒の体積")
panel_2 = Panel("円錐の計算")

pi_2 = Pi(Factor=1)
sqr_2 = Square(Value="1.5")
panel_3 = Panel("s1")
panel_4 = Panel("s2")
data = Data(multiplication)
multiplication_3 = Multiplication(A=sqr_2, B=pi_2)
multiplication_4 = Multiplication(A="4.3", B=data)
multiplication_5 = Multiplication(A="0.8", B=multiplication_3)
subtraction_2 = Subtraction(A=multiplication_4, B=multiplication_5)
division = Division(A=subtraction_2, B=3)

division_2 = Division(A="1.75", B=2)
sqr_3 = Square(Value=division_2)
pi_3 = Pi(Factor=1)
multiplication_6 = Multiplication(A=sqr_3, B=pi_3)
R = ClusterOutput(division)
addition = Addition(A=multiplication_2, B=division)
R_2 = ClusterOutput(multiplication_6)

# ==== cluster Cluster_6
data = ClusterInput()
crv = ClusterInput()
panel = Panel("複数のAd-Objに対応するようにする")
data_2 = Data(data)
crv_2 = Curve(crv)
mcx = MeshCurve(Mesh=data_2, Curve=crv_2)  # -> Points, Faces
python = GhPythonScript(x=mcx.Points)  # -> out, a; inputs x: list
# ---------- python: Python ----------
__author__ = "m0rya"

import rhinoscriptsyntax as rs

if len(x) == 0:
    a = True
else:
    a = False
# ---------- end python ----------
dispatch = Dispatch(List=graft(crv_2), DispatchPattern=python.a)  # -> ListA, ListB
crv_3 = Curve(dispatch.ListB)
crv_4 = Curve(dispatch.ListA)
crv_cp = CurveClosestPoint(Point=mcx.Points, Curve=crv_3)  # -> Point, Parameter, Distance
trim = TrimTree(Tree=crv_4, Depth=1)
shatter = Shatter(Curve=crv_3, Parameters=crv_cp.Parameter)
midpt = CurveMiddle(Curve=shatter)
minc = MeshInclusion(Mesh=data_2, Point=midpt, Strict=False)
dispatch_2 = Dispatch(List=shatter, DispatchPattern=minc)  # -> ListA, ListB
crv_5 = Curve(dispatch_2.ListB)
trim_2 = TrimTree(Tree=crv_5, Depth=1)
trim_3 = TrimTree(Tree=trim_2, Depth=1)
merge = Merge(Data1=trim, Data2=trim_3)
R = ClusterOutput(merge)

# ==== cluster FGAMAdSlicer
crv = ClusterInput()
mesh = ClusterInput()
trim_path = TrimPath(mesh=mesh, crv=crv)
panel = Panel("Trim Additional Shell")
data = ClusterInput()
vec = ClusterInput()
N = ClusterInput()
num = ClusterInput()
crv_2 = Curve(crv)
crv_3 = Curve(trim_path)
vec_2 = Vector(vec)
data_2 = Data(data)
panel_2 = Panel(crv_2)
num_2 = Number(num)
bbox = BoundingBox(Content=data_2, Plane=PlaneXY(0, 0, 0))  # -> Box, Box_2
xy = XYPlane(Origin=vec_2)
debox = DeconstructBox(Box=bbox.Box)  # -> Plane, X, Y, Z
series = Series(Start="10", Step=N, Count=num_2)
V = ClusterInput()
python = GhPythonScript(x=crv_2)  # -> out, a; inputs x: list
# ---------- python: Python ----------
__author__ = "m0rya"

import rhinoscriptsyntax as rs


if len(x) == 2:
    a = x[1]
# ---------- end python ----------
volume = Volume(Geometry=bbox.Box)  # -> Volume, Centroid
dedomain = DeconstructDomain(Domain=debox.X)  # -> Start, End
series_2 = Series(Start=0, Step=N, Count=num_2)
dedomain_2 = DeconstructDomain(Domain=debox.Y)  # -> Start, End
matrix = ConstructMatrix(Rows=1, Columns=4, Values=V)
scale = Scale(Geometry=bbox.Box, Center=volume.Centroid, Factor="1.5")  # -> Geometry, Transform
msh2psrf = MeshToPolysurface(Mesh=mesh, Triangles=False, FaceMerge=False)
subtraction = Subtraction(A=dedomain.Start, B=series)
subtraction_2 = Subtraction(A=dedomain_2.Start, B=series)
addition = Addition(A=dedomain.End, B=series)
addition_2 = Addition(A=dedomain_2.End, B=series)
sec = BrepPlane(Brep=scale.Geometry, Plane=xy)  # -> Curves, Points
panel_3 = Panel("""fgamの部分を、一定の距離の前から吐出するようにするやつ

FGAMの割合で吐出するやつはTrue
、普通の割合で吐出するやつはFalse""")
dom = ConstructDomain(DomainStart=subtraction, DomainEnd=addition)
dom_2 = ConstructDomain(DomainStart=subtraction_2, DomainEnd=addition_2)
offset = OffsetCurve(Curve=sec.Curves, Distance=series_2, Plane=PlaneXY(0, 0, 0), Corners=1)
rectangle = Rectangle(Plane=PlaneXY(0, 0, 0), XSize=dom, YSize=dom_2, Radius=0)  # -> Rectangle, Length
trim = TrimTree(Tree=offset, Depth=1)  # -> simplify(Tree)
python_2 = GhPythonScript(x=trim)  # -> out, a, b, c
# ---------- python_2: Python ----------
__author__ = "m0rya"

import rhinoscriptsyntax as rs

def calc_e(dist):
    multiplier = 0.9
    filamentDia = 1.75
    layerHeight = 0.2
    nozzleDiameter = 0.5
        
        
    resultE = multiplier * (dist * layerHeight * nozzleDiameter) / (3.14 * (filamentDia/2.0) * (filamentDia/2.0))
  
    return resultE

def calc_dist(e):
    
    multiplier = 0.9
    filamentDia = 1.75
    layerHeight = 0.2
    nozzleDia = 0.5
    
    dist = (3.14 * (filamentDia/2.0) * (filamentDia/2.0) * e) / (multiplier * layerHeight * nozzleDia)
    
    return dist
    
a = rs.CurveDomain(x)

b = rs.CurveStartPoint(x)

c = rs.CurveEndPoint(x)
# ---------- end python_2 ----------
crvdom = CurveDomain(Curve=trim)  # -> Curve, Domain
len = Length(Curve=rectangle.Rectangle)
panel_4 = Panel("Generate G-Code")
dom_3 = ConstructDomain(DomainStart=0, DomainEnd=len)
crvdom_2 = CurveDomain(Curve=rectangle.Rectangle, Domain=dom_3)  # -> Curve, Domain
X = UnitX(Factor=1)
vec_3 = VectorXYZ(XComponent=0, YComponent=0, ZComponent=0)  # -> Vector, Length
division = Division()
move = Move(Geometry=crvdom_2.Curve, Motion=graft(vec_2))  # -> simplify(Geometry), Transform
crv_4 = Curve(move.Geometry)
python_3 = GhPythonScript(obj=msh2psrf, bCrv=crv, param=matrix, bbCrv=crv_4)  # -> out, a, debug, path, info; inputs bCrv: list, bbCrv: list
# ---------- python_3: Python ----------
__author__ = "m0rya"

import rhinoscriptsyntax as rs

def calc_e(dist):
    multiplier = 0.9
    filamentDia = 1.75
    layerHeight = 0.2
    nozzleDiameter = 0.5
        
        
    resultE = multiplier * (dist * layerHeight * nozzleDiameter) / (3.14 * (filamentDia/2.0) * (filamentDia/2.0))
  
    return resultE
        
def calc_dist(e):
    
    multiplier = 0.9
    filamentDia = 1.75
    layerHeight = 0.2
    nozzleDia = 0.5
    
    dist = (3.14 * (filamentDia/2.0) * (filamentDia/2.0) * e) / (multiplier * layerHeight * nozzleDia)
    
    return dist
   
   
result = []
debug = []
intervalE = 5

path = []
info = []

#レイヤーのパスごとに処理


for i in range(len(bCrv)):
    
    intervalE = 5
    

    

    
    #objでパスを分割
    interP = rs.CurveBrepIntersect(bCrv[i], obj)
    
 
   
        
    if (interP == None) or (len(interP[1]) < 2):
        path.extend([bbCrv[i], bCrv[i]])
        info.extend([False, False])
        continue
    
    
    
    closestParam = []
    for p in interP[1]:
        closestParam.append(rs.CurveClosestPoint(bCrv[i], p))
    
 
    
    splitedCrv = rs.SplitCurve(bCrv[i], closestParam)
    

    
    #normalとfgamでカーブ分割
    #normalとfgamのカーブは一個ずつという想定
    
    fgamCrv = None
    normalCrv = None
    
    for s in splitedCrv:
        
        midP = rs.CurveMidPoint(s)
        
        if rs.IsPointInSurface(obj, midP):
            fgamCrv = s
        else:
            normalCrv = s
            
                   
            
    #分割したあと
    #FGAMの部分が吐出されるnE前にその割合で吐出するようにする
    
    #intervalE分、前の地点を検出
    
    fgamDist = rs.CurveLength(fgamCrv)
    
    
 
    #artifactにintervalEが含まれている。
    if calc_e(rs.CurveLength(normalCrv)) < intervalE:
        
        intervalE -= calc_e(rs.CurveLength(normalCrv))
                
        artifactDom = rs.CurveDomain(bbCrv[i])
        
        artifactLen = rs.CurveLength(bbCrv[i])
        intervalLen = calc_dist(intervalE)
        
        
        intervalParam = ((artifactDom[1]-artifactDom[0]) * (artifactLen-intervalLen)) / artifactLen + artifactDom[0]
        
        splited = rs.SplitCurve(bbCrv[i], intervalParam)
    
        
   
    
        #スプリットしたartifactでfgamcrv分を取り出す
        if rs.CurveLength(splited[1]) > rs.CurveLength(fgamCrv):
            
            tmpDom = rs.CurveDomain(splited[1])
            
            splitedLen = rs.CurveLength(splited[1])
            fgamLen = rs.CurveLength(fgamCrv)
            
            fgamParam = ((tmpDom[1]-tmpDom[0]) * fgamLen) / splitedLen + tmpDom[0]
            
            fgamSplited = rs.SplitCurve(splited[1], fgamParam)
            
            
            
            path.extend([splited[0], fgamSplited[0], fgamSplited[1]])
            info.extend([False, True, False])
            
            path.extend([normalCrv, fgamCrv])
            info.extend([False, False])
            
            
            debug.append(fgamSplited[0])
            
            
            
    
            
            
        else:
            continue
            
    else:
        
        continue
        
                
                
     
                
                
            
        
        
    '''
    #normalCrvの時点でintervalEを含んでいる。
    else:
        
    '''
# ---------- end python_3 ----------
panel_5 = Panel(python_3.out)
crv_5 = Curve(python_3.debug)
python_4 = GhPythonScript(crv=crv_3, param=matrix, bbCrv=move.Geometry)  # -> out, simplify(GCode); inputs crv: list, bbCrv: list
# ---------- python_4: Python ----------
__author__ = "m0rya"

import rhinoscriptsyntax as rs

retract_value = 0.5
mSpeed = 1000
eSpeed = 500

baseRatio = [0.9, 0.1, 0.0, 0.0]

def calc_e(dist):
        multiplier = 0.9
        filamentDia = 1.75
        layerHeight = 0.2
        nozzleDiameter = 0.5
        
        
        resultE = multiplier * (dist * layerHeight * nozzleDiameter) / (3.14 * (filamentDia/2.0) * (filamentDia/2.0))
  
        return resultE
    
    
resultCode = []


#Ad-Crvがある場合
#Artifactを作ってから、Ad-Crvを吐出
if len(crv) != 0:
    
    for itr,c in enumerate(crv):
        
        tmpCode = []
        
        tmpCode.append("; Artifact\n")
        tmpCode.append("G92 E0\n")
        e_value = 0
        
        ratio = [param[0,0], param[0,1], param[0,2], param[0,3]]
        tmpCode.append("M567 P0 E{0[0]}:{0[1]}:{0[2]}:{0[3]}\n".format(ratio))
        
        
        #build Artifact
        if itr*2 < len(bbCrv):
            exploded = rs.ExplodeCurves(bbCrv[itr*2])
        else:
            exploded = rs.ExplodeCurves(bbCrv[0])
        
        
        for itr2,e in enumerate(exploded):
            
            tmp_e_value = calc_e(rs.CurveLength(e))
            start = rs.CurveStartPoint(e)
            end = rs.CurveEndPoint(e)
            
            if itr2 == 0:
               
                tmpCode.append("G1 E{0}\n".format(e_value-retract_value))
                
                tmpCode.append("G0 X{0} Y{1} F{2}\n".format(start.X, start.Y, mSpeed))
                
                tmpCode.append("G1 E{0}\n".format(e_value))
                
            e_value += tmp_e_value
            tmpCode.append("G1 X{0} Y{1} E{2} F{3}\n".format(end.X, end.Y, e_value, eSpeed))
        
        
        
        
        #build Ad-Crv
        exploded = rs.ExplodeCurves(c)
        tmpCode.append("; FGAM Slice\n")
        for itr2, e in enumerate(exploded):
            
            tmp_e_value = calc_e(rs.CurveLength(e))
            start = rs.CurveStartPoint(e)
            end = rs.CurveEndPoint(e)
            
            if itr2 == 0:
               
                tmpCode.append("G1 E{0}\n".format(e_value-retract_value))
                
                tmpCode.append("G0 X{0} Y{1} F{2}\n".format(start.X, start.Y, mSpeed))
                
                tmpCode.append("G1 E{0}\n".format(e_value))
                
            e_value += tmp_e_value
            tmpCode.append("G1 X{0} Y{1} E{2} F{3}\n".format(end.X, end.Y, e_value, eSpeed))
        
        
        
        #build Artifact again
        tmpCode.append("; Artifact\n")
        if itr*2 < len(bbCrv):
            exploded = rs.ExplodeCurves(bbCrv[itr*2])
        else:
            exploded = rs.ExplodeCurves(bbCrv[0])
        
        ratioCode = "M567 P0 E{0[0]}:{0[1]}:{0[2]}:{0[3]}\n".format(baseRatio)
        tmpCode.append(ratioCode)
        
        for itr2,e in enumerate(exploded):
            
            tmp_e_value = calc_e(rs.CurveLength(e))
            start = rs.CurveStartPoint(e)
            end = rs.CurveEndPoint(e)
            
            if itr2 == 0:
               
                tmpCode.append("G1 E{0}\n".format(e_value-retract_value))
                
                tmpCode.append("G0 X{0} Y{1} F{2}\n".format(start.X, start.Y, mSpeed))
                
                tmpCode.append("G1 E{0}\n".format(e_value))
                
            e_value += tmp_e_value
            tmpCode.append("G1 X{0} Y{1} E{2} F{3}\n".format(end.X, end.Y, e_value, eSpeed))
        
        
        
        resultCode.append(''.join(tmpCode))
        
        
    GCode = resultCode
    
    
#Ad-Crvがない場合
#Artifactだけ作って終わり     
else:
    
    tmpCode = []
    
    tmpCode.append("; Artifact\n")
    tmpCode.append("G92 E0\n")
    
    ratioCode = "M567 P0 E{0[0]}:{0[1]}:{0[2]}:{0[3]}\n".format(baseRatio)
    tmpCode.append(ratioCode)
    e_value = 0
    
    
    for crv in bbCrv:
        
        exploded = rs.ExplodeCurves(crv)
        
        for itr,e in enumerate(exploded):
            
            tmp_e_value = calc_e(rs.CurveLength(e))
            start = rs.CurveStartPoint(e)
            end = rs.CurveEndPoint(e)
            
            
            if itr == 0:
               
                tmpCode.append("G1 E{0}\n".format(e_value-retract_value))
                
                tmpCode.append("G0 X{0} Y{1} F{2}\n".format(start.X, start.Y, mSpeed))
                
                tmpCode.append("G1 E{0}\n".format(e_value))
                
            e_value += tmp_e_value
            tmpCode.append("G1 X{0} Y{1} E{2} F{3}\n".format(end.X, end.Y, e_value, eSpeed))
        
        
        
    tmpCode.append("G92 E0\n")
    GCode = [''.join(tmpCode)]
# ---------- end python_4 ----------
python_5 = GhPythonScript(param=matrix, path=python_3.path, info=python_3.info)  # -> out, a, debug; inputs path: tree, info: tree
# ---------- python_5: Python ----------
__author__ = "m0rya"

import Rhino
import rhinoscriptsyntax as rs
import ghpythonlib.treehelpers as th

def calc_e(dist):
    multiplier = 0.9
    filamentDia = 1.75
    layerHeight = 0.2
    nozzleDiameter = 0.5
        
        
    resultE = multiplier * (dist * layerHeight * nozzleDiameter) / (3.14 * (filamentDia/2.0) * (filamentDia/2.0))
  
    return resultE
    


result = []

retract_value = 0.5
mSpeed = 1000
eSpeed = 500

baseRatio = [0.8, 0.2, 0.0, 0.0]
debug = []

for i in range(path.BranchCount):
    
    tmpCrv = []
    tmpInfo = []
    
    for j in range(len(path.Branch(i))):
        
        if info.Branch(i)[j]:
            
            tmpCode = [";FGAM Slice\n"]
            tmpCode.append("G92 E0\n")
            
            ratio = [param[0,0], param[0,1], param[0,2], param[0,3]]
            tmpCode.append("M567 P0 E{0[0]}:{0[1]}:{0[2]}:{0[3]}\n".format(ratio))
            
            e_value = 0
            
            
            
            if rs.IsCurveLinear(path.Branch(i)[j]):
                
                tmp_e_value = calc_e(rs.CurveLength(path.Branch(i)[j]))
                start = rs.CurveStartPoint(path.Branch(i)[j])
                end = rs.CurveEndPoint(path.Branch(i)[j])
                
                tmpCode.append("G1 E{0}\n".format(e_value-retract_value))
                
                tmpCode.append("G0 X{0} Y{1} F{2}\n".format(start.X, start.Y, mSpeed))
                
                tmpCode.append("G1 E{0}\n".format(e_value))
            
                e_value += tmp_e_value
                tmpCode.append("G1 X{0} Y{1} E{2} F{3}\n".format(end.X, end.Y, e_value, eSpeed))
                
                
            else:    
                exploded = rs.ExplodeCurves(path.Branch(i)[j])
            
 
                for itr, e in enumerate(exploded):
                    
                    tmp_e_value = calc_e(rs.CurveLength(e))
                    start = rs.CurveStartPoint(e)
                    end = rs.CurveEndPoint(e)
                
                
                    if itr == 0:
                    
                        tmpCode.append("G1 E{0}\n".format(e_value-retract_value))
                
                        tmpCode.append("G0 X{0} Y{1} F{2}\n".format(start.X, start.Y, mSpeed))
                
                        tmpCode.append("G1 E{0}\n".format(e_value))
            
                    e_value += tmp_e_value
                    tmpCode.append("G1 X{0} Y{1} E{2} F{3}\n".format(end.X, end.Y, e_value, eSpeed))
            
            tmpCode.append("M567 P0 E{0[0]}:{0[1]}:{0[2]}:{0[3]}\n".format(baseRatio))
            resultCode = ''.join(tmpCode)
            tmpInfo.append(resultCode)
        
            
        else:
            
            tmpInfo.append(False)
            
    
    result.append([tmpInfo, path.Branch(i)])
    
    
result = th.list_to_tree(result)

a = result
# ---------- end python_5 ----------
line = LineSDL(Start=vec_3.Vector, Direction=X, Length=1)
panel_6 = Panel(move.Geometry)
a = ClusterOutput(python_5.a)
# unite crv and g-code
python_6 = GhPythonScript(x=simplify(crv_3), y=python_4.GCode)  # -> out, simplify(a), debug; inputs x: tree, y: tree
# ---------- python_6: Python ----------
__author__ = "m0rya"

import Rhino
import rhinoscriptsyntax as rs
import ghpythonlib.treehelpers as th


result = []

for i in range(x.BranchCount):
    
    if len(x.Branch(i)) > 0:
        result.append([[y.Branch(i)], x.Branch(i)])
    else:
        
        
        result.append([[y.Branch(i)], [None]])
        
        
        
        
result = th.list_to_tree(result)

a = result
# ---------- end python_6 ----------
python_7 = GhPythonScript(x=line)  # -> out, a
# ---------- python_7: Python ----------
__author__ = "m0rya"

import rhinoscriptsyntax as rs



a = rs.ExplodeCurves(x)
# ---------- end python_7 ----------
panel_7 = Panel(python_5.a)
crv_6 = ClusterOutput(crv_3)
crv_7 = Curve(python_5.debug)
a_2 = ClusterOutput(python_6.a)
explode = Explode(Curve=line, Recursive=True)  # -> Segments, Vertices
panel_8 = Panel(python_6.debug)
panel_9 = Panel(python_6.a)
panel_10 = Panel(python_5.out)

# ==== cluster Cluster_7

panel = Panel("""; initial G-Code
G90
M82
G92 E0.000
G28 X0.000 Y0.000 Z0.000
G1 Z10.000 F3000.000
M106 P0 S255
M190 S0
M109 S195""")
panel_2 = Panel("""; End G-Code
; z+5
M140 S0.0
M104 S0.0
M106 S0.0
M84""")

panel_3 = ClusterOutput(panel)
panel_4 = ClusterOutput(panel_2)

# ==== cluster FakeWeaveAdSlicer
mesh = ClusterInput()
crv = ClusterInput()
trim_path = TrimPath_2(mesh=mesh, crv=crv)  # -> crv_6, R
crv_2 = Curve(trim_path.crv_6)
len = Length(Curve=crv_2)
smaller = SmallerThan(FirstNumber=len, SecondNumber=Slider(2, range=0..10))  # -> SmallerThan, OrEqualTo
D = ClusterInput()
dispatch = Dispatch(List=crv_2, DispatchPattern=smaller.SmallerThan)  # -> ListA, ListB
len_2 = Length(Curve=dispatch.ListB)
dom = ConstructDomain(DomainStart=0, DomainEnd=len_2)
bang = ExplodeTree(Data=graft(D))  # -> Branch0, Branch1, Branch2
crvdom = CurveDomain(Curve=dispatch.ListB, Domain=dom)  # -> Curve, Domain
crv_3 = Curve(crvdom.Curve)
len_3 = Length(Curve=crv_3)
divide = DivideCurve(Curve=crv_3, Count=len_3, Kinks=False)  # -> Points, Tangents, Parameters
pline = PolyLine(Vertices=divide.Points, Closed=False)
tree_fixer = GhPythonScript(x=crv_3, y=pline)  # -> out, simplify(a); inputs x: tree, y: tree; same code as tree_fixer
number_slider = Slider(0.1, range=0..1)
python = GhPythonScript(crv=tree_fixer.a, dLen=bang.Branch0, mLen=bang.Branch1, z=bang.Branch2)  # -> out, a; inputs crv: tree
# ---------- python: Python ----------
__author__ = "m0rya"

import rhinoscriptsyntax as rs
import ghpythonlib.treehelpers as th
import Rhino


a = []
prePnt = None
result = []

switch = True

stepKey = int(dLen/0.2)-z

for i in range(int(crv.BranchCount)):
    
    
    if i%stepKey == 0:
        switch = not switch
        
    
    tmpCrv = []
    print(len(crv.Branch(i)))
    
    if len(crv.Branch(i)) != 0 and crv.Branch(i)[0] != None:
        
        cs = crv.Branch(i)
        
        if cs[0] == None:
            result.append(tmpCrv)
            continue
        
        for c in cs:
            
           
            if c == None:
                continue
                
            if prePnt == None:
                
                prePnt = rs.EvaluateCurve(c, 0)
                
            cDom = rs.CurveDomain(c)
            baseT = rs.CurveClosestPoint(c, prePnt)
            params = []
                
            tmpT = baseT
            tmpT -= dLen/2
                
            while tmpT > 0:
                params.append(tmpT)
                tmpT -= dLen
            
            params.append(0)
                    
            params.sort()
                
            tmpT = baseT
            tmpT += dLen/2
            if len(params) != 1:
                params.pop(len(params)-1)
            while tmpT < cDom[1]:
                params.append(tmpT)
                tmpT += dLen
            
            params.append(cDom[1])
                
                
            divided = [rs.EvaluateCurve(c, p) for p in params]
            
            wavePnts = []
            for itr, d in enumerate(divided):
                    
                    if itr == 0 or itr == (len(divided)-1):
                        wavePnts.append(d)
                    
                    else:
                
                        tmpVec = rs.VectorSubtract(divided[itr], divided[itr-1])
                        
                        if switch:
                            rAngle = 90 if itr%2 == 1 else -90
                        else:
                            rAngle = -90 if itr%2 == 1 else 90
                            
                        rotated = rs.VectorRotate(tmpVec, rAngle, (0,0,1))
                        unitized = rs.VectorUnitize(rotated)
                        scaled = rs.VectorScale(unitized, mLen)
                        
                        added = rs.PointAdd(divided[itr], scaled)
                        
                        wavePnts.append(added)
                        
            wavedCrv = rs.AddInterpCurve(wavePnts)
            tmpCrv.append(wavedCrv)
        prePnt = rs.EvaluateCurve(cs[0], 0)  
        
    result.append(tmpCrv)
result = th.list_to_tree(result, source=[0,0])
a = result
# ---------- end python ----------
crv_4 = Curve(simplify(python.a))
crv_5 = Curve(trim_path.R)
topoly = CurveToPolyline(Curve=crv_4, ToleranceDistance=number_slider, ToleranceAngle=number_slider)  # -> Polyline, Segments
merge = Merge(Data1=simplify(topoly.Polyline), Data2=simplify(crv_5))
join = JoinCurves(Curves=merge, Preserve=False)  # -> simplify(Curves)
python_2 = GhPythonScript(x=join)  # -> out, simplify(a)
# ---------- python_2: Python ----------
__author__ = "m0rya"

import rhinoscriptsyntax as rs

a = False
# ---------- end python_2 ----------
C = ClusterOutput(join)
a = ClusterOutput(python_2.a)
panel = Panel(join)

# ==== cluster BOAAdSlicer
mesh = ClusterInput()
crv = ClusterInput()
trim_path = TrimPath_2(mesh=mesh, crv=crv)  # -> crv_6, R
crv_2 = Curve(trim_path.R)
crv_3 = Curve(trim_path.crv_6)
crv_4 = Curve(crv_2)
params = ClusterInput()
crv_5 = Curve(crv_3)
boa = GhPythonScript(crvs=crv_5, params=params)  # -> out, simplify(a); inputs crvs: list, params: list
# ---------- boa: Python ----------
__author__ = "m0rya"

import rhinoscriptsyntax as rs

boaHeight = params[0]
boaSpeed = params[1]
boaMultiplier = params[2]
retract_value = 0.5



def calc_e(dist, multiplier=0.9):
    filamentDia = 1.75
    layerHeight = 0.2
    nozzleDiameter = 0.4
        
    resultE = multiplier * (dist * layerHeight * nozzleDiameter) / (3.14 * (filamentDia/2.0) * (filamentDia/2.0))
  
    return resultE

gcode = []

for c in crvs:
    
    tmpCode = ["; Boa Print\n", "G92 E0\n"]
    e_value = 0
    
    if rs.IsCurveLinear(c):
        exploded = [c]
    else:
        exploded = rs.ExplodeCurves(c)
        
        
    for itr, e in enumerate(exploded):
        
        curve_length = rs.CurveLength(e)
        tmp_e_value = calc_e(curve_length, boaMultiplier)
        
        start = rs.CurveStartPoint(e)
        end = rs.CurveEndPoint(e)
        
        if itr == 0:
            tmpCode.append("G1 E{0}\n".format(e_value - retract_value))
            tmpCode.append("G1 X{0} Y{1} F{2}\n".format(start.X, start.Y, 2500))
            
            #move Z
            #Z上に移動しながら吐出
            tmpCode.append("G91 ;set relative position\n")
            tmpCode.append("G1 Z{0} E{1}\n".format(boaHeight, calc_e(boaHeight)))
            tmpCode.append("G90 ;set absolute position\n")
            
            
        e_value += tmp_e_value
        tmpCode.append("G1 X{0} Y{1} E{2} F{3}\n".format(end.X, end.Y, e_value, boaSpeed))
            
        
            
            
    else:
            
        #move Z
        tmpCode.append("G92 E0\n")
        tmpCode.append("G91 ;set relative position\n")
        tmpCode.append("G1 Z{0} E{1}\n".format(boaHeight*-1, -1*retract_value))
        tmpCode.append("G90 ; set absolute position\n")
        tmpCode.append("G92 E0\n")
            
        
        
    gcode.append(''.join(tmpCode))
    
    
a = gcode
# ---------- end boa ----------
python = GhPythonScript(x=crv_4)  # -> out, simplify(a); inputs x: list
# ---------- python: Python ----------
__author__ = "m0rya"

import rhinoscriptsyntax as rs

result = []

for i in x:
    result.append(False)
    
    
a = result
# ---------- end python ----------
merge = Merge(Data1=crv_4, Data2=crv_5)
merge_2 = Merge(Data1=python.a, Data2=boa.a)
R = ClusterOutput(merge)
R_2 = ClusterOutput(merge_2)

# ==== cluster HairAdSlicer
crv = ClusterInput()
data = ClusterInput()
crv_2 = Curve(crv)
mesh = ClusterInput()
data_2 = Data(data)
trim_path = TrimPath_2(mesh=mesh, crv=crv_2)  # -> crv_6, R
bang = ExplodeTree(Data=graft(data_2))  # -> Branch0, Branch1, Branch2, Branch3
item = ListItem(List=crv_2, Index=0, Wrap=True)
crv_3 = Curve(trim_path.crv_6)
offset = OffsetCurve(Curve=item, Distance=bang.Branch0, Plane=PlaneXY(0, 0, 0), Corners=1)  # -> simplify(Curve)
crv_4 = Curve(trim_path.R)
python = GhPythonScript(crvs=crv_3, offsetCrvs=offset, params=data_2)  # -> out, simplify(resultCrv), simplify(resultInfo), forPreview; inputs crvs: tree, offsetCrvs: tree, params: list
# ---------- python: Python ----------
__author__ = "m0rya"

import rhinoscriptsyntax as rs
import ghpythonlib.treehelpers as th
import Rhino


mSpeed = 2000
eSpeed = 1000

retractValue = 0.5

length_hair = params[0]
hori_interval = params[1]
ver_interval = params[2]
thickness_hair = params[3]

forPreview = []

z_move = 5

def calc_e(dist):
    multiplier = 0.9
    filamentDia = 1.75
    layerHeight = 0.2
    nozzleDiameter = 0.4
        
    resultE = multiplier * (dist * layerHeight * nozzleDiameter) / (3.14 * (filamentDia/2.0) * (filamentDia/2.0))
  
    return resultE

def crv2gcode(crv):
        
    gcode = []
        
    gcode.append("G92 E0\n")
    e_value = 0
        
    if rs.IsCurveLinear(crv):
        exploded = [crv]
            
    else:
        exploded = rs.ExplodeCurves(crv)
            
            
    for itr, e in enumerate(exploded):
            
        crv_length = rs.CurveLength(e)
        tmp_e_value = calc_e(crv_length)
            
        start = rs.CurveStartPoint(e)
        end = rs.CurveEndPoint(e)
            
        #G0
        if itr == 0:
            gcode.append("G1 E{0}\n".format(e_value - retractValue))
            gcode.append("G0 X{0} Y{1} F{2}\n".format(start.X, start.Y, mSpeed))
            gcode.append("G1 E{0}\n".format(e_value))
        
        #G1
        e_value += tmp_e_value
        gcode.append("G1 X{0} Y{1} E{2} F{3}\n".format(end.X, end.Y, e_value, eSpeed))
          
    return ''.join(gcode)
        
        
def crv2hair(crv, multiplier=0.8):
    
    gcode = []
    
    gcode.append("G92 E0\n")
    e_value = 0
    
    start = rs.CurveStartPoint(crv)
    end = rs.CurveEndPoint(crv)
    
    gcode.append("G1 E{0}\n".format(e_value - retractValue))
    gcode.append("G0 X{0} Y{1} F{2}\n".format(start.X, start.Y, mSpeed))
    
    crv_length = rs.CurveLength(crv)
    e_value += calc_e(crv_length) * multiplier
    
    gcode.append("G1 E{0}\n".format(e_value))
    gcode.append("G1 X{0} Y{1} F{2}\n".format(end.X, end.Y, eSpeed))
    
    return ''.join(gcode)
    
    
    
result = []
resultInfo = []


#layerごとに走査
for i in range(crvs.BranchCount):
    
    tmpCrv = []
    tmpInfo = []
    
    #artifact追加
    artiInfo = []
    for o in offsetCrvs.Branch(i):
        
        artiInfo.append(crv2gcode(o))
        
    tmpCrv.extend(offsetCrvs.Branch(i))
    tmpInfo.extend(artiInfo)
    
    
    
    #partion crvがあったら
    if len(crvs.Branch(i)) != 0:
        
        
        #vertical intervalによって毛を生やす
        if i % int(ver_interval) == 0:
            
            for itr, c in enumerate(crvs.Branch(i)):
            
                #最初だけ毛を生やす
                if itr == 0:
                
                    hairInfo = ""
                
                    #普通に線を吐出
                    hairInfo += crv2gcode(c)
                
                
                    #逆から毛を生やしていく
                    crv_length = rs.CurveLength(c)
                    divided = rs.DivideCurve(c, int(crv_length/hori_interval))
                    divided.reverse()
                
                    hairInfo += "; hair\n"
                
                    for itr2, pnt in enumerate(divided):
                    
                        if itr2 == 0:
                        
                            #move to pnt
                            hairInfo += "G1 X{0} Y{1} F{2}\n".format(pnt.X, pnt.Y, mSpeed)
                        
                        else:
                            #z up
                            hairInfo += "G91\n"
                            hairInfo += "G1 Z{0}\n".format(z_move)
                            hairInfo += "G90\n"
                        
                            #move to pnt
                            hairInfo += "G1 X{0} Y{1} F{2}\n".format(pnt.X, pnt.Y, mSpeed)
                        
                            #z down
                            hairInfo += "G91\n"
                            hairInfo += "G1 Z{0}\n".format(-1*z_move)
                            hairInfo += "G90\n"
                        
                        
                        #create hair line
                        closestParam = rs.CurveClosestPoint(offsetCrvs.Branch(i)[0], pnt)
                        closestPnt = rs.EvaluateCurve(offsetCrvs.Branch(i)[0], closestParam)
                        
                        hair_vec = rs.PointSubtract(closestPnt, pnt)
                        unitized = rs.VectorUnitize(hair_vec)
                        scaled = rs.VectorScale(unitized, 0.5)
                        addedPnt = rs.PointAdd(closestPnt, scaled)
                        
                        hair_crv = rs.AddLine(pnt, addedPnt)
                        
                        #単純に線を吐出
                        '''
                        hairInfo += crv2gcode(hair_crv)
                        '''
                        
                        
                        #糸引きで吐出
                        hairInfo += crv2hair(hair_crv, thickness_hair)
                        forPreview.append(hair_crv)
                
                    else:
                        tmpCrv.append(c)
                        tmpInfo.append(hairInfo)
            
                #最初以外はそのまま
                else:
                    tmpCrv.append(c)
                    tmpInfo.append(False)
            
            else:
                result.append(tmpCrv)
                resultInfo.append(tmpInfo)
        
        #partion crvはあるが、毛を生やさない
        else:
            
            for c in crvs.Branch(i):
                tmpCrv.append(c)
                tmpInfo.append(False)
            
            result.append(tmpCrv)
            resultInfo.append(tmpInfo)
            
    #partion crvなし 
    else:
        result.append(tmpCrv)
        resultInfo.append(tmpInfo)
        

resultCrv = th.list_to_tree(result, source=[0])
resultInfo = th.list_to_tree(resultInfo, source=[0])
# ---------- end python ----------
python_2 = GhPythonScript(x=crv_4)  # -> out, a; inputs x: list
# ---------- python_2: Python ----------
__author__ = "m0rya"

import rhinoscriptsyntax as rs


a = [False for i in range(len(x))]
# ---------- end python_2 ----------
crv_5 = Curve(crv_4)
data_3 = Data(python_2.a)
crv_6 = Curve(python.resultCrv)
panel = Panel(python.resultCrv)
merge = Merge(Data1=simplify(data_3), Data2=simplify(python.resultInfo))
crv_7 = Curve(python.forPreview)
merge_2 = Merge(Data1=simplify(crv_5), Data2=simplify(crv_6))
R = ClusterOutput(merge)
crv_8 = ClusterOutput(crv_7)
R_2 = ClusterOutput(merge_2)

# ==== cluster BassSlicer
data = ClusterInput()
data_2 = ClusterInput()
data_3 = Data(data)
data_4 = Data(data_2)
python = GhPythonScript(x=data_3)  # -> out, a; inputs x: tree
# ---------- python: Python ----------
__author__ = "m0rya"

import rhinoscriptsyntax as rs


a = x.Branch(1)[1]
# ---------- end python ----------
cluster = Cluster_8(C=data_4, data=python.a)
Z = UnitZ(Factor=cluster)
python_2 = GhPythonScript(x=data_3)  # -> out, a; inputs x: tree
# ---------- python_2: Python ----------
__author__ = "m0rya"

import rhinoscriptsyntax as rs


a = x.Branch(4)[1]
# ---------- end python_2 ----------
python_3 = GhPythonScript(x=data_3)  # -> out, a; inputs x: tree
# ---------- python_3: Python ----------
__author__ = "m0rya"

import rhinoscriptsyntax as rs


a = x.Branch(0)[1]
# ---------- end python_3 ----------
data_5 = Data(Z)
base_slice = BaseSlice(M=data_4, T=Z, N=python_3.a, C=python_2.a)  # -> crv_2, i, D
data_6 = ClusterOutput(data_5)
crv = Curve(base_slice.D)
crv_2 = ClusterOutput(crv)

# ==== cluster TrimPath
mesh = ClusterInput()
crv = ClusterInput()
mesh_2 = Mesh(mesh)
crv_2 = Curve(crv)
mcx = MeshCurve(Mesh=mesh_2, Curve=crv_2)  # -> Points, Faces
crv_cp = CurveClosestPoint(Point=mcx.Points, Curve=graft(crv_2))  # -> Point, Parameter, Distance
shatter = Shatter(Curve=graft(crv_2), Parameters=crv_cp.Parameter)  # -> simplify(Segments)
trim = TrimTree(Tree=shatter, Depth=1)
midpt = CurveMiddle(Curve=trim)
minc = MeshInclusion(Mesh=mesh_2, Point=midpt, Strict=False)  # -> simplify(Inside)
dispatch = Dispatch(List=trim, DispatchPattern=minc)  # -> simplify(ListA), ListB
crv_3 = Curve(dispatch.ListA)
crv_4 = ClusterOutput(crv_3)

# ==== cluster TrimPath_2
crv = ClusterInput()
mesh = ClusterInput()
crv_2 = Curve(crv)
mesh_2 = Mesh(mesh)
mcx = MeshCurve(Mesh=mesh_2, Curve=crv_2)  # -> Points, Faces
tree_fixer = GhPythonScript(x=crv_2, y=mcx.Points)  # -> out, simplify(a); inputs x: tree, y: tree
# ---------- tree_fixer: Python ----------
__author__ = "m0rya"

import rhinoscriptsyntax as rs
import ghpythonlib.treehelpers as th
import Rhino


result = []
count = 0

#layer by layer
for i in range(x.BranchCount):
    tmp = []
    
    for j in range(len(x.Branch(i))):
        tmp.extend(y.Branch(count))
        count += 1
    
    result.append(tmp)
    
    
    
a = th.list_to_tree(result, source=[0,0])
# ---------- end tree_fixer ----------
python = GhPythonScript(x=tree_fixer.a)  # -> out, a; inputs x: list
# ---------- python: Python ----------
__author__ = "m0rya"

import rhinoscriptsyntax as rs


a = False if len(x)==0 else True
# ---------- end python ----------
crv_cp = CurveClosestPoint(Point=mcx.Points, Curve=graft(crv_2))  # -> Point, Parameter, Distance
dispatch = Dispatch(List=crv_2, DispatchPattern=python.a)  # -> ListA, ListB
shatter = Shatter(Curve=graft(crv_2), Parameters=crv_cp.Parameter)  # -> simplify(Segments)
crv_3 = Curve(dispatch.ListB)
refine = Refine(Mesh=mesh_2, Level=1)
tree_fixer_2 = GhPythonScript(x=crv_2, y=shatter)  # -> out, simplify(a); inputs x: tree, y: tree; same code as tree_fixer
midpt = CurveMiddle(Curve=tree_fixer_2.a)
minc = MeshInclusion(Mesh=refine, Point=midpt, Strict=False)  # -> simplify(Inside)
panel = Panel(tree_fixer_2.a)
dispatch_2 = Dispatch(List=tree_fixer_2.a, DispatchPattern=minc)  # -> simplify(ListA), ListB
crv_4 = Curve(dispatch_2.ListA)
crv_5 = Curve(dispatch_2.ListB)
merge = Merge(Data1=simplify(crv_5), Data2=simplify(crv_3))
panel_2 = Panel(merge)
crv_6 = ClusterOutput(crv_4)
R = ClusterOutput(merge)

# ==== cluster BaseSlice
T = ClusterInput()
M = ClusterInput()
N = ClusterInput()
C = ClusterInput()

xy = XYPlane(Origin=Point(0, 0, 0))
move = Move(Geometry=xy, Motion=T)  # -> Geometry, Transform
sec = MeshPlane(Mesh=M, Plane=move.Geometry)
crv = Curve(simplify(sec))
series = Series(Start=0, Step=N, Count=C)
neg = Negative(Value=series)
offset = Offset(Curve=simplify(graft(crv)), Distance=flatten(neg), Plane=PlaneXY(0, 0, 0), Corners=1)
trim = TrimTree(Tree=offset, Depth=1)

panel = Panel("1レイヤーに複数のシェルがある場合のパスのトリムを柔軟にできるようにする")
pshift = ShiftPaths(Data=offset, Offset=-1)
crv_2 = ClusterOutput(crv)
trim_2 = TrimTree(Tree=trim, Depth=1)
item = ListItem(List=trim, Index=-1, Wrap=True)
D = ClusterOutput(pshift)
panel_2 = Panel(pshift)
i = ClusterOutput(item)

# ==== cluster Cluster_8
C = ClusterInput()
data = ClusterInput()
bbox = BoundingBox(Content=C, Plane=PlaneXY(0, 0, 0))  # -> Box, Box_2
data_2 = Data(data)
debox = DeconstructBox(Box=bbox.Box)  # -> Plane, X, Y, Z
num = Number(debox.Z)
division = Division(A=num, B=data_2)
series = Series(Start=0, Step=data_2, Count=division)
S = ClusterOutput(series)
